# Grasshopper definition 0_07_Save_Load_Aggregation.ghx (Grasshopper 1.0.7)

# ----
# Press the button to make sure the file is
# updated to latest Wasp version on your pc.
button = Button()
updatefile = Wasp_UpdateFile(UPDATE=button)  # -> LOG; inputs UPDATE: Boolean; plug-in component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

pt = Point([<point referenced from the Rhino model> x3])
crv = Curve([<curve referenced from the Rhino model> x3])
# 0_07_Save_Load_Aggregation
geo = Geometry(<brep referenced from the Rhino model>)
pt_2 = Point([<point referenced from the Rhino model> x2])
crv_2 = Curve([<curve referenced from the Rhino model> x2])
geo_2 = Geometry(<brep referenced from the Rhino model>)
conndir = Wasp_ConnectionFromDirection(GEO=geo, CEN=pt, UP=crv)  # -> CONN, PLN_OUT; inputs GEO: Mesh, CEN: list of Point3d, UP: list of Curve, T: list; plug-in component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
conndir_2 = Wasp_ConnectionFromDirection(GEO=geo_2, CEN=pt_2, UP=crv_2)  # -> CONN, PLN_OUT; inputs GEO: Mesh, CEN: list of Point3d, UP: list of Curve, T: list; plug-in component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
# # Wasp: Discrete Design with Grasshopper plug-in (GPL) initiated by Andrea Rossi
# 
# 
# This file is part of Wasp.
# 
# Copyright (c) 2021, Andrea Rossi <a.rossi.andrea@gmail.com>
# 
# Wasp is free software; you can redistribute it and/or modify it under the terms of the GNU General Public License as published by the Free Software Foundation; either version 3 of the License, or (at your option) any later version.
# 
# Wasp is distributed in the hope that it will be useful, but WITHOUT ANY WARRANTY; without even the implied warranty of MERCHANTABILITY or FITNESS FOR A PARTICULAR PURPOSE. See the GNU General Public License for more details. You should have received a copy of the GNU General Public License
#  along with Wasp; If not, see <http://www.gnu.org/licenses/>.
# 
# license GPL-3.0 <https://www.gnu.org/licenses/gpl.html>
# 
# Significant parts of Wasp have been developed by Andrea Rossi as part of research on digital materials and discrete design at DDU Digital Design Unit - Prof. Oliver Tessmann - Technische Universität Darmstadt
panel = Panel("HEX")
part = Wasp_BasicPart(NAME=panel, GEO=geo, CONN=flatten(conndir.CONN))  # -> PART; inputs GEO: Mesh, CONN: list, ATTR: list; plug-in component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
part_2 = Wasp_BasicPart(NAME="CUB", GEO=geo_2, CONN=flatten(conndir_2.CONN))  # -> PART; inputs GEO: Mesh, CONN: list, ATTR: list; plug-in component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
merge = Merge(Data1=part, Data2=part_2)

rulegen = Wasp_RulesGenerator(PART=merge, SELF_P=Toggle(False))  # -> R; inputs PART: list, SELF_P: Boolean, SELF_C: Boolean, TYP: Boolean, GR: list; plug-in component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

stochasticaggregation = Wasp_StochasticAggregation(PART=flatten(merge), N=Slider(100, range=0..1000), RULES=rulegen, RESET=Button())  # -> AGGR, PART_OUT; inputs PART: list, PREV: list, N: Int32, RULES: list, SEED: Int32, MODE: Int32, GC: list, RESET: Boolean; plug-in component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
partgeo = Wasp_GetPartGeometry(PART=stochasticaggregation.PART_OUT)  # -> GEO; plug-in component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
preview = CustomPreview(Geometry=partgeo, Material=ColourSwatch(SwatchColor=RGB(255, 105, 105)))

# ----
# 1. SAVE AGGREGATION TO FILE
# The aggregation is saved in a .json file which can be
# later re-imported in Grasshopper using the WaspLoad component.
panel_2 = Panel("D:\GitHub\Wasp\ExampleFiles\0.Basics")
click_to_save = Button()
saveaggr = Wasp_SaveAggregationToFile(AGGR=stochasticaggregation.AGGR, PATH=panel_2, NAME="my_Aggregation_01", SAVE=click_to_save)  # -> TXT, FILE; inputs SAVE: Boolean; plug-in component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
saved_file_path = Panel(saveaggr.FILE)

# ----
# 2. LOAD SAVED AGGREGATION FROM FILE
# The loaded aggregation can be used as starting point for a new aggregation.
# Just plug the PART_OUT output to the PREV input of an Aggregation component.
# If Parts have been removed from the Aggregation, setting RENUM to True ensures
# that the Part IDs remain sequential and consistent with what Wasp expects.
file_to_import = Panel("D:\GitHub\Wasp\ExampleFiles\0.Basics\my_Aggregation_01.json")
loadaggr = Wasp_LoadAggregationFromFile(PART=merge, FILE=file_to_import)  # -> PART_OUT; inputs PART: list, RENUM: Boolean; plug-in component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
partgeo_2 = Wasp_GetPartGeometry(PART=loadaggr)  # -> GEO; plug-in component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
preview_2 = CustomPreview(Geometry=partgeo_2, Material=ColourSwatch(SwatchColor=RGB(102, 30, 30)))
