# Grasshopper definition 0_10_Aggregation_Graph.ghx (Grasshopper 1.0.7)

# ----
# Press the button to make sure the file is
# updated to latest Wasp version on your pc.
button = Button()
# 0_10_Aggregation_Graph
updatefile = Wasp_UpdateFile(UPDATE=button)  # -> LOG; inputs UPDATE: Boolean; plug-in component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

part_geometry = Brep(<brep referenced from the Rhino model>)
connections_centers = Point([<point referenced from the Rhino model> x3])
connections_x_axis = Curve([<curve referenced from the Rhino model> x3])
conndir = Wasp_ConnectionFromDirection(GEO=part_geometry, CEN=connections_centers, UP=connections_x_axis)  # -> CONN, PLN_OUT; inputs GEO: Mesh, CEN: list of Point3d, UP: list of Curve, T: list; plug-in component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
# # Wasp: Discrete Design with Grasshopper plug-in (GPL) initiated by Andrea Rossi
# 
# 
# This file is part of Wasp.
# 
# Copyright (c) 2021, Andrea Rossi <a.rossi.andrea@gmail.com>
# 
# Wasp is free software; you can redistribute it and/or modify it under the terms of the GNU General Public License as published by the Free Software Foundation; either version 3 of the License, or (at your option) any later version.
# 
# Wasp is distributed in the hope that it will be useful, but WITHOUT ANY WARRANTY; without even the implied warranty of MERCHANTABILITY or FITNESS FOR A PARTICULAR PURPOSE. See the GNU General Public License for more details. You should have received a copy of the GNU General Public License
#  along with Wasp; If not, see <http://www.gnu.org/licenses/>.
# 
# license GPL-3.0 <https://www.gnu.org/licenses/gpl.html>
# 
# Significant parts of Wasp have been developed by Andrea Rossi as part of research on digital materials and discrete design at DDU Digital Design Unit - Prof. Oliver Tessmann - Technische Universität Darmstadt
part_name = Panel("HEXA")
points = PointList(Points=connections_centers, Size=Slider(2, range=0..10))
part = Wasp_BasicPart(NAME=part_name, GEO=part_geometry, CONN=flatten(conndir.CONN))  # -> PART; inputs GEO: Mesh, CONN: list, ATTR: list; plug-in component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

parts_num = Slider(100, range=0..1000)
rulegen = Wasp_RulesGenerator(PART=part)  # -> R; inputs PART: list, SELF_P: Boolean, SELF_C: Boolean, TYP: Boolean, GR: list; plug-in component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
reset = Button()
stochasticaggregation = Wasp_StochasticAggregation(PART=flatten(part), N=parts_num, RULES=rulegen, RESET=reset)  # -> AGGR, PART_OUT; inputs PART: list, PREV: list, N: Int32, RULES: list, SEED: Int32, MODE: Int32, GC: list, RESET: Boolean; plug-in component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

partgeo = Wasp_GetPartGeometry(PART=stochasticaggregation.PART_OUT)  # -> GEO; plug-in component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
preview = CustomPreview(Geometry=partgeo, Material=ColourSwatch(SwatchColor=RGBA(119, 255, 0, 50)))

# ----
# The Aggregation Graph component allows to visualize the graph of the generated aggregation:
# - the FG input allows to choose between full graph (including adjacent connections not directly defined)
# or only the graph describing the rules sequence.
# - the TOL input allows to override the default tolerance below which two elements are considered
# connected
# - when FG is set to True, setting FR to True filters "accidental" connections found against the given
# aggregation rules.
# - The CR input allows to specify a custom set of rules for filtering. If not specified, the component uses
# the Aggregation rules.
# - the F input allows to choose between flattened or tree-structured output
panel = Panel("""HEXA|0_HEXA|0
HEXA|0_HEXA|1
HEXA|0_HEXA|2
HEXA|1_HEXA|0""")
ruletxt = Wasp_RuleFromText(TXT=panel)  # -> R; plug-in component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
aggregationgraph = Wasp_AggregationGraph(
    AGGR=stochasticaggregation.AGGR,
    FG=Toggle(True),
    TOL=Slider(0.5, range=0..1),
    FR=Toggle(False),
    CR=ruletxt,
    F=Toggle(False))  # -> G, N, E, ES_ID, EE_ID, CS_ID, CE_ID; inputs FG: Boolean, FR: Boolean, CR: list, F: Boolean; plug-in component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

graph_edges = Curve(aggregationgraph.E)
graph_nodes = Point(aggregationgraph.N)
preview_2 = CustomPreview(Geometry=graph_nodes, Material=ColourSwatch(SwatchColor=RGB(255, 0, 0)))
preview_3 = CustomPreview(Geometry=graph_edges, Material=ColourSwatch(SwatchColor=RGB(0, 0, 0)))
