# Grasshopper definition 1_04_Rules_Visualizer.ghx (Grasshopper 1.0.7)

# ----
# Press the button to make sure the file is
# updated to latest Wasp version on your pc.
button = Button()
updatefile = Wasp_UpdateFile(UPDATE=button)  # -> LOG; inputs UPDATE: Boolean; plug-in component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

# ----
# 1_04_Rules_Visualizer
geo = Geometry(<brep referenced from the Rhino model>)
geo_2 = Geometry(<brep referenced from the Rhino model>)
geo_3 = Geometry(<brep referenced from the Rhino model>)
crv = Curve([<curve referenced from the Rhino model> x3])
pt = Point([<point referenced from the Rhino model> x3])
crv_2 = Curve([<curve referenced from the Rhino model> x2])
crv_3 = Curve([<curve referenced from the Rhino model> x3])
pt_2 = Point([<point referenced from the Rhino model> x3])
pt_3 = Point([<point referenced from the Rhino model> x2])
# # Wasp: Discrete Design with Grasshopper plug-in (GPL) initiated by Andrea Rossi
# 
# 
# This file is part of Wasp.
# 
# Copyright (c) 2021, Andrea Rossi <a.rossi.andrea@gmail.com>
# 
# Wasp is free software; you can redistribute it and/or modify it under the terms of the GNU General Public License as published by the Free Software Foundation; either version 3 of the License, or (at your option) any later version.
# 
# Wasp is distributed in the hope that it will be useful, but WITHOUT ANY WARRANTY; without even the implied warranty of MERCHANTABILITY or FITNESS FOR A PARTICULAR PURPOSE. See the GNU General Public License for more details. You should have received a copy of the GNU General Public License
#  along with Wasp; If not, see <http://www.gnu.org/licenses/>.
# 
# license GPL-3.0 <https://www.gnu.org/licenses/gpl.html>
# 
# Significant parts of Wasp have been developed by Andrea Rossi as part of research on digital materials and discrete design at DDU Digital Design Unit - Prof. Oliver Tessmann - Technische Universität Darmstadt
# Wasp DevLog #006 - Rules Visualizer
panel = Panel("HEXA")

conndir = Wasp_ConnectionFromDirection(GEO=geo_3, CEN=pt_2, UP=crv_3, T="TRI")  # -> CONN, PLN_OUT; inputs GEO: Mesh, CEN: list of Point3d, UP: list of Curve, T: list; plug-in component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
conndir_2 = Wasp_ConnectionFromDirection(GEO=geo, CEN=pt, UP=crv, T="HEXA")  # -> CONN, PLN_OUT; inputs GEO: Mesh, CEN: list of Point3d, UP: list of Curve, T: list; plug-in component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
conndir_3 = Wasp_ConnectionFromDirection(GEO=geo_2, CEN=pt_3, UP=crv_2, T="BOX")  # -> CONN, PLN_OUT; inputs GEO: Mesh, CEN: list of Point3d, UP: list of Curve, T: list; plug-in component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

part = Wasp_BasicPart(NAME=panel, GEO=geo, CONN=flatten(conndir_2.CONN))  # -> PART; inputs GEO: Mesh, CONN: list, ATTR: list; plug-in component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
part_2 = Wasp_BasicPart(NAME="BOX", GEO=geo_2, CONN=flatten(conndir_3.CONN))  # -> PART; inputs GEO: Mesh, CONN: list, ATTR: list; plug-in component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
part_3 = Wasp_BasicPart(NAME="TRI", GEO=geo_3, CONN=flatten(conndir.CONN))  # -> PART; inputs GEO: Mesh, CONN: list, ATTR: list; plug-in component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
merge = Merge(Data1=part, Data2=part_3, Data3=part_2)

rulegen = Wasp_RulesGenerator(PART=merge, SELF_P=Toggle(True), SELF_C=Toggle(True), TYP=Toggle(False))  # -> R; inputs PART: list, SELF_P: Boolean, SELF_C: Boolean, TYP: Boolean, GR: list; plug-in component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

# ----
# Rules Visualizer
# This component allows to visualize the result of each rule available with the selected
# modular system. Rules can be filtered using the different options in the rules generator,
# and then visualized.
# The rules also display their index in the rules list, as well as the associated rule grammar.
# Both these attributes can be then used to filter the different rules for aggregation.
panel_2 = Panel("-500")
pt_4 = ConstructPoint(XCoordinate=panel_2, YCoordinate=0, ZCoordinate=0)
xy = XYPlane(Origin=pt_4)
ruleviz = Wasp_RulesVisualizer(PART=merge, R=rulegen, SF=Slider(2.4, range=0..10), PLN=xy, SI=Toggle(True), ST=Toggle(True))  # -> BP, NP, RTL, RT; inputs PART: list, R: list, PLN: Plane, SI: Boolean, ST: Boolean; plug-in component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
tag = TextTag3D(Location=ruleviz.RTL, Text=ruleviz.RT, Size=Slider(3, range=0..10), Justification=7)

# ----
# Using the indices displayed in the Rules Visualizer,
# it is possible to manually select specific rules from
# the list generated through the Rules Generator.
panel_3 = Panel("""6
43
49
59
33
10""")
item = ListItem(List=rulegen, Index=panel_3, Wrap=True)

stochasticaggregation = Wasp_StochasticAggregation(PART=flatten(merge), N=Slider(250, range=0..1000), RULES=item, RESET=Button())  # -> AGGR, PART_OUT; inputs PART: list, PREV: list, N: Int32, RULES: list, SEED: Int32, MODE: Int32, GC: list, RESET: Boolean; plug-in component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

# ----
# Visualization: Selected Rules
number_slider = Slider(50, range=0..100)
rectangle = Rectangle(Plane=ruleviz.RTL, XSize=number_slider, YSize=number_slider, Radius=0)  # -> Rectangle, Length
item_2 = ListItem(List=rectangle.Rectangle, Index=panel_3, Wrap=True)

# ----
# Visualization: Rule Base Part
panel_4 = Panel("""HEXA
TRI
BOX""")
namefilter = Wasp_FilterPartsByName(PART=ruleviz.BP, NAME=panel_4)  # -> PART_OUT, MASK; inputs PART: list, NAME: list; plug-in component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
partgeo = Wasp_GetPartGeometry(PART=namefilter.PART_OUT)  # -> GEO; plug-in component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
merge_2 = Merge(
    Data1=ColourSwatch(SwatchColor=RGB(255, 0, 0)),
    Data2=ColourSwatch(SwatchColor=RGB(255, 0, 234)),
    Data3=ColourSwatch(SwatchColor=RGB(72, 0, 255)))
medges = MeshEdges(Mesh=partgeo)  # -> NakedEdges, InteriorEdges, NonManifoldEdges
trim = TrimTree(Tree=medges.InteriorEdges, Depth=1)
preview = CustomPreview(Geometry=trim, Material=graft(merge_2))

# ----
# Visualization: Rule New Part
panel_5 = Panel("""HEXA
TRI
BOX""")
namefilter_2 = Wasp_FilterPartsByName(PART=ruleviz.NP, NAME=panel_5)  # -> PART_OUT, MASK; inputs PART: list, NAME: list; plug-in component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
partgeo_2 = Wasp_GetPartGeometry(PART=namefilter_2.PART_OUT)  # -> GEO; plug-in component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
merge_3 = Merge(
    Data1=ColourSwatch(SwatchColor=RGB(255, 128, 128)),
    Data2=ColourSwatch(SwatchColor=RGB(255, 128, 244)),
    Data3=ColourSwatch(SwatchColor=RGB(164, 128, 255)))
preview_2 = CustomPreview(Geometry=partgeo_2, Material=graft(merge_3))

panel_6 = Panel("""HEXA
TRI
BOX""")
namefilter_3 = Wasp_FilterPartsByName(PART=stochasticaggregation.PART_OUT, NAME=panel_6)  # -> PART_OUT, MASK; inputs PART: list, NAME: list; plug-in component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
partgeo_3 = Wasp_GetPartGeometry(PART=namefilter_3.PART_OUT)  # -> GEO; plug-in component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
merge_4 = Merge(
    Data1=ColourSwatch(SwatchColor=RGB(255, 0, 0)),
    Data2=ColourSwatch(SwatchColor=RGB(255, 0, 234)),
    Data3=ColourSwatch(SwatchColor=RGB(72, 0, 255)))
preview_3 = CustomPreview(Geometry=partgeo_3, Material=graft(merge_4))
