# Grasshopper definition 2_04_Field_from_Expression.ghx (Grasshopper 1.0.7)

# ----
# Press the button to make sure the file is
# updated to latest Wasp version on your pc.
button = Button()
# # Wasp: Discrete Design with Grasshopper plug-in (GPL) initiated by Andrea Rossi
# 
# 
# This file is part of Wasp.
# 
# Copyright (c) 2021, Andrea Rossi <a.rossi.andrea@gmail.com>
# 
# Wasp is free software; you can redistribute it and/or modify it under the terms of the GNU General Public License as published by the Free Software Foundation; either version 3 of the License, or (at your option) any later version.
# 
# Wasp is distributed in the hope that it will be useful, but WITHOUT ANY WARRANTY; without even the implied warranty of MERCHANTABILITY or FITNESS FOR A PARTICULAR PURPOSE. See the GNU General Public License for more details. You should have received a copy of the GNU General Public License
#  along with Wasp; If not, see <http://www.gnu.org/licenses/>.
# 
# license GPL-3.0 <https://www.gnu.org/licenses/gpl.html>
# 
# Significant parts of Wasp have been developed by Andrea Rossi as part of research on digital materials and discrete design at DDU Digital Design Unit - Prof. Oliver Tessmann - Technische Universität Darmstadt
# 2_04_Field_from_Expression
updatefile = Wasp_UpdateFile(UPDATE=button)  # -> LOG; inputs UPDATE: Boolean; plug-in component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

# ----
# FIELD FROM EXPRESSION
# A gradient field can be generated from mathematical expressions.
# In this example, the mathematical function of a Gyroid is applied on
# the coordinates of the grid points, generating a field distribution following
# the Gyroid surface itself.
number_slider = Slider(150, range=0..1000)
box = DomainBox(Base=PlaneXY(0, 0, 0), X=number_slider, Y=number_slider, Z=number_slider)
fieldpts = Wasp_FieldPoints(BOU=box, RES=Slider(5, range=0..10))  # -> E_FIELD, PTS; inputs BOU: list of Mesh, PLN: Plane; plug-in component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
pt = Point(fieldpts.PTS)
pdecon = Deconstruct(Point=pt)  # -> XComponent, YComponent, ZComponent
expression = Expression(
    x=pdecon.XComponent,
    y=pdecon.YComponent,
    z=pdecon.ZComponent,
    scale=Slider(25, range=0..100),
    Expression="sin(x/scale)*cos(y/scale)+sin(y/scale)*cos(z/scale)+sin(z/scale)*cos(x/scale)")
graph = GraphMapper(expression, x0=0, x1=1, y0=0, y1=1, container_name="Gaussian", factor=0.5097402334, mean=0.4988763928, sdev=0.2044943571)
field = Wasp_Field(NAME="myCurveField", E_FIELD=fieldpts.E_FIELD, VAL=graph)  # -> FIELD; inputs VAL: list; plug-in component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

# ----
# !!! Adding the brep geometry as attribute
# allows to carry it with the aggregation
brep = Brep(<brep referenced from the Rhino model>)
crv = Curve([<curve referenced from the Rhino model> x8])
pt_2 = Point([<point referenced from the Rhino model> x8])
conndir = Wasp_ConnectionFromDirection(GEO=brep, CEN=pt_2, UP=crv)  # -> CONN, PLN_OUT; inputs GEO: Mesh, CEN: list of Point3d, UP: list of Curve, T: list; plug-in component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
attribute = Wasp_Attribute(ID="baseGeo", VAL=brep, TR=Toggle(True))  # -> ATTR; inputs VAL: list, TR: Boolean; plug-in component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
points = PointList(Points=pt_2, Size=Slider(2, range=0..10))
part_name = Panel("P")
part = Wasp_BasicPart(NAME=part_name, GEO=brep, CONN=flatten(conndir.CONN), ATTR=attribute)  # -> PART; inputs GEO: Mesh, CONN: list, ATTR: list; plug-in component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

panel = Panel("""P|0_P|6
P|6_P|0
P|1_P|7
P|7_P|1
P|2_P|4
P|4_P|2
P|3_P|5
P|5_P|3""")
ruletxt = Wasp_RuleFromText(TXT=panel)  # -> R; plug-in component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

# ----
# Visualize Field Points
number_slider_2 = Slider(0.2, range=0..1)
defield = Wasp_DeconstructField(FIELD=field)  # -> NAME, PTS, COUNT, RES, PLN, VAL, BOU, BB; plug-in component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
larger = LargerThan(FirstNumber=defield.VAL, SecondNumber=number_slider_2)  # -> LargerThan, OrEqualTo
cull = CullPattern(List=defield.VAL, CullPattern=larger.LargerThan)
cull_2 = CullPattern(List=defield.PTS, CullPattern=larger.LargerThan)
gradient = Gradient(LowerLimit=0, UpperLimit=1, Parameter=cull, stops=[0: RGB(0, 128, 0), 0.5: RGB(255, 255, 0), 1: RGB(255, 0, 0)])
preview = CustomPreview(Geometry=cull_2, Shader=gradient)

# ----
# Visualize Field Isolines
number_slider_3 = Slider(0.53, range=0..1)
plane = ValueList({"XY": 0, "YZ": 1, "XZ": 2}, selected="YZ")
fieldiso = Wasp_FieldIsolines(FIELD=field, PLN=plane, T=Slider(0.512, range=0..1), ISO=number_slider_3)  # -> CRV; inputs PLN: Int32; plug-in component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
gradient_2 = Gradient(
    LowerLimit=0,
    UpperLimit=1,
    Parameter=number_slider_3,
    stops=[0: RGB(0, 128, 0), 0.5: RGB(255, 255, 0), 1: RGB(255, 0, 0)])
preview_2 = CustomPreview(Geometry=fieldiso, Shader=gradient_2)

# ----
# Visualize Field IsoVoxels
number_slider_4 = Slider(0.127, range=0..1)
fieldvox = Wasp_FieldIsoVoxels(FIELD=field, ISO=number_slider_4)  # -> VM; plug-in component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
medges = MeshEdges(Mesh=fieldvox)  # -> NakedEdges, InteriorEdges, NonManifoldEdges
preview_3 = CustomPreview(Geometry=[medges.NakedEdges, medges.InteriorEdges], Material=ColourSwatch(SwatchColor=RGB(255, 255, 255)))

number_slider_5 = Slider(1500, range=0..5000)
fieldaggregation = Wasp_FieldDrivenAggregation(PART=flatten(part), N=number_slider_5, RULES=ruletxt, FIELD=field, RESET=Button())  # -> AGGR, PART_OUT; inputs PART: list, PREV: list, N: Int32, RULES: list, FIELD: list, MODE: Int32, GC: list, RESET: Boolean; plug-in component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

# ----
# Extracting the attribute containing
# the base brep geometry
random = Random(Range=Domain(0, 1), Number=number_slider_5, Seed=2)
gradient_3 = Gradient(LowerLimit=0, UpperLimit=1, Parameter=random, stops=[0: RGB(204, 204, 204), 1: RGB(117, 117, 117)])
getattr = Wasp_GetAttributeByName(PART=fieldaggregation.PART_OUT, ID="baseGeo")  # -> VAL; plug-in component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
preview_4 = CustomPreview(Geometry=flatten(getattr), Material=gradient_3)
