# Grasshopper definition 2_05_Field_from_Kangaroo.ghx (Grasshopper 1.0.7)
# plug-ins: MeshEdit Components, Kangaroo2 Components

# ----
# Press the button to make sure the file is
# updated to latest Wasp version on your pc.
button = Button()
# # Wasp: Discrete Design with Grasshopper plug-in (GPL) initiated by Andrea Rossi
# 
# 
# This file is part of Wasp.
# 
# Copyright (c) 2021, Andrea Rossi <a.rossi.andrea@gmail.com>
# 
# Wasp is free software; you can redistribute it and/or modify it under the terms of the GNU General Public License as published by the Free Software Foundation; either version 3 of the License, or (at your option) any later version.
# 
# Wasp is distributed in the hope that it will be useful, but WITHOUT ANY WARRANTY; without even the implied warranty of MERCHANTABILITY or FITNESS FOR A PARTICULAR PURPOSE. See the GNU General Public License for more details. You should have received a copy of the GNU General Public License
#  along with Wasp; If not, see <http://www.gnu.org/licenses/>.
# 
# license GPL-3.0 <https://www.gnu.org/licenses/gpl.html>
# 
# Significant parts of Wasp have been developed by Andrea Rossi as part of research on digital materials and discrete design at DDU Digital Design Unit - Prof. Oliver Tessmann - Technische Universität Darmstadt
# 2_05_Field_From_Kangaroo_Meshes
updatefile = Wasp_UpdateFile(UPDATE=button)  # -> LOG; inputs UPDATE: Boolean; plug-in component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

# ----
# KANGAROO SPRING NETWORK
# In this example, Kangaroo is used to create a spring network from a mesh and then relax
# the network under a constant force. The Kangaroo Zombie solver is used to avoid having
# calculation loops in Grasshopper.
number_slider = Slider(250, range=0..1000)
number_slider_2 = Slider(25, range=0..100)
planesrf = PlaneSurface(Plane=PlaneXY(0, 0, 0), XSize=number_slider, YSize=number_slider)
area = Area(Geometry=planesrf)  # -> Area, Centroid
divide = DivideDomain²(Domain=planesrf, UCount=number_slider_2, VCount=number_slider_2)
subsrf = Isotrim(Surface=planesrf, Domain=divide)
area_2 = Area(Geometry=subsrf)  # -> Area, Centroid
dist = Distance(PointA=area_2.Centroid, PointB=area.Centroid)
larger = LargerThan(FirstNumber=dist, SecondNumber=Slider(40, range=0..100))  # -> LargerThan, OrEqualTo
cull = CullPattern(List=subsrf, CullPattern=larger.LargerThan)
mesh = MeshBrep(
    Brep=cull,
    Settings={GridMaxCount=0, GridMinCount=16, JaggedSeams=False, MaxEdgeLength=0, MinEdgeLength=0.0001, MinTolerance=0, Refine=True, RefineAngle=0, RelativeTolerance=0.65, SimplePlanes=True, Tolerance=0})
mjoin = MeshJoin(Meshes=mesh)
weldvertices = MeshWeldVertices(Mesh=mjoin, Tolerance=0.01)  # -> RuntimeMessage, Mesh
medges = MeshEdges(Mesh=weldvertices.Mesh)  # -> NakedEdges, InteriorEdges, NonManifoldEdges
join = JoinCurves(Curves=medges.NakedEdges, Preserve=False)
demesh = DeconstructMesh(Mesh=weldvertices.Mesh)  # -> Vertices, Faces, Colours, Normals
explode = Explode(Curve=join, Recursive=True)  # -> Segments, Vertices
Z = UnitZ(Factor=Slider(2.5, range=0..10))
edgelengths = EdgeLengths(Mesh=weldvertices.Mesh, LengthFactor=Slider(1, range=0..1), Strength=1)
anchor = Anchor(Point=explode.Vertices, Strength=10000)
show = Show(G=weldvertices.Mesh)
load = Load(Point=demesh.Vertices, ForceVector=Z, Weighting=1)
zombiesolver = ZombieSolver(GoalObjects=[edgelengths, load, anchor, show], Threshold=1e-10, Tolerance=0.01, MaxIterations=50000)  # -> I, V, O
clean = CleanTree(RemoveNulls=True, RemoveInvalid=True, RemoveEmpty=False, Tree=zombiesolver.O)
item = ListItem(List=clean, Index=0, Wrap=True)
medges_2 = MeshEdges(Mesh=item)  # -> NakedEdges, InteriorEdges, NonManifoldEdges
preview = CustomPreview(Geometry=[medges_2.NakedEdges, medges_2.InteriorEdges], Material=ColourSwatch(SwatchColor=RGB(255, 0, 0)))

# ----
# FIELD FROM KANGAROO
# The resulting mesh is used to generate a distance field, driving the aggregation
# to grow along the mesh itself.
# A graph mapper is used to sharpen the transition between values in the field.
number_slider_3 = Slider(1.25, range=0..10)
bbox = BoundingBox(Content=item, Plane=PlaneXY(0, 0, 0))  # -> Box, Box_2
volume = Volume(Geometry=bbox.Box)  # -> Volume, Centroid
scale_nu = ScaleNU(
    Geometry=bbox.Box,
    Plane=volume.Centroid,
    ScaleX=number_slider_3,
    ScaleY=Slider(1.25, range=0..10),
    ScaleZ=Slider(1.5, range=0..10))  # -> Geometry, Transform
fieldpts = Wasp_FieldPoints(BOU=scale_nu.Geometry, RES=Slider(10, range=0..10))  # -> E_FIELD, PTS; inputs BOU: list of Mesh, PLN: Plane; plug-in component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
pull = PullPoint(Point=fieldpts.PTS, Geometry=item, ClosestOnly=True)  # -> ClosestPoint, Distance
bnd = Bounds(Numbers=pull.Distance)
remap = RemapNumbers(Value=pull.Distance, Source=bnd, Target="1 To 0")  # -> Mapped, Clipped
graph = GraphMapper(remap.Mapped, x0=0, x1=1, y0=0, y1=1, container_name="Bezier", cpx=[0, 0, 0, 1], cpy=[0, 1, 1, 1])
field = Wasp_Field(NAME="kangarooField", E_FIELD=fieldpts.E_FIELD, VAL=graph)  # -> FIELD; inputs VAL: list; plug-in component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

part_geometry = Brep(<brep referenced from the Rhino model>)
connections_centers = Point([<point referenced from the Rhino model> x14])
connections_x_axis = Curve([<curve referenced from the Rhino model> x14])
conndir = Wasp_ConnectionFromDirection(GEO=part_geometry, CEN=connections_centers, UP=connections_x_axis)  # -> CONN, PLN_OUT; inputs GEO: Mesh, CEN: list of Point3d, UP: list of Curve, T: list; plug-in component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
points = PointList(Points=connections_centers, Size=Slider(2, range=0..10))
part_name = Panel("OCTA")
part = Wasp_BasicPart(NAME=part_name, GEO=part_geometry, CONN=flatten(conndir.CONN))  # -> PART; inputs GEO: Mesh, CONN: list, ATTR: list; plug-in component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

octa_octa = Panel("""OCTA|0_OCTA|6
OCTA|6_OCTA|0
OCTA|1_OCTA|7
OCTA|7_OCTA|1
OCTA|2_OCTA|4
OCTA|4_OCTA|2
OCTA|3_OCTA|5
OCTA|5_OCTA|3""")
ruletxt = Wasp_RuleFromText(TXT=octa_octa)  # -> R; plug-in component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

# ----
# PLANE CONSTRAINT
# A Plane Constraint is used to prevent
# the aggregation from growing below
# the XY plane.
# 
# NB: for more info on Constraints, see
# the relative example section.
xy = XYPlane(Origin=Point(0, 0, 0))
planeconst = Wasp_PlaneConstraint(PLN=xy)  # -> PC; inputs PLN: Plane, POS: Boolean, SOFT: Boolean, REQ: Boolean, PART: list; plug-in component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

parts_num = Slider(1000, range=0..5000)
reset = Button()
fieldaggregation = Wasp_FieldDrivenAggregation(PART=flatten(part), N=parts_num, RULES=ruletxt, FIELD=field, MODE=Slider(2, range=0..10), GC=planeconst, RESET=reset)  # -> AGGR, PART_OUT; inputs PART: list, PREV: list, N: Int32, RULES: list, FIELD: list, MODE: Int32, GC: list, RESET: Boolean; plug-in component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

partgeo = Wasp_GetPartGeometry(PART=fieldaggregation.PART_OUT)  # -> GEO; plug-in component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
preview_2 = CustomPreview(Geometry=partgeo, Material=ColourSwatch(SwatchColor=RGBA(255, 225, 0, 141)))
