# Grasshopper definition 2_07_Save_Load_Field.ghx (Grasshopper 1.0.7)

# ----
# Press the button to make sure the file is
# updated to latest Wasp version on your pc.
button = Button()
# 2_07_Save_Load_Fields
updatefile = Wasp_UpdateFile(UPDATE=button)  # -> LOG; inputs UPDATE: Boolean; plug-in component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

geo = Geometry(<brep referenced from the Rhino model>)
fieldpts = Wasp_FieldPoints(BOU=geo, RES=Slider(5, range=0..10))  # -> E_FIELD, PTS; inputs BOU: list of Mesh, PLN: Plane; plug-in component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
crv = Curve(<curve referenced from the Rhino model>)
pull = PullPoint(Point=fieldpts.PTS, Geometry=crv, ClosestOnly=True)  # -> ClosestPoint, Distance
bnd = Bounds(Numbers=pull.Distance)
remap = RemapNumbers(Value=pull.Distance, Source=bnd, Target="1 To 0")  # -> Mapped, Clipped
graph = GraphMapper(
    remap.Mapped,
    x0=0,
    x1=1,
    y0=0,
    y1=1,
    container_name="Bezier",
    cpx=[0, 0.7842696905, 0.8359550834, 1],
    cpy=[0, 0.02272725105, 0.4642857313, 1])
field = Wasp_Field(E_FIELD=fieldpts.E_FIELD, VAL=graph)  # -> FIELD; inputs VAL: list; plug-in component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

# ----
# LOAD
# Once a Field has been saved with the SaveField component,
# it can be quickly reloaded in Grasshopper using the LoadField
# component. This allows to split Field generation and aggregation
# in two separate files, avoiding costly computing.
# The LOAD input can be triggered with a button to reload the file
# after changes.
button_2 = Button()
path = FilePath("D:\Github\Wasp\ExampleFiles\2.Fields\myField.json")
loadfield = Wasp_LoadFieldFromFile(FILE=path, LOAD=button_2)  # -> FIELD; inputs LOAD: Boolean; plug-in component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

# ----
# # Wasp: Discrete Design with Grasshopper plug-in (GPL) initiated by Andrea Rossi
# 
# 
# This file is part of Wasp.
# 
# Copyright (c) 2021, Andrea Rossi <a.rossi.andrea@gmail.com>
# 
# Wasp is free software; you can redistribute it and/or modify it under the terms of the GNU General Public License as published by the Free Software Foundation; either version 3 of the License, or (at your option) any later version.
# 
# Wasp is distributed in the hope that it will be useful, but WITHOUT ANY WARRANTY; without even the implied warranty of MERCHANTABILITY or FITNESS FOR A PARTICULAR PURPOSE. See the GNU General Public License for more details. You should have received a copy of the GNU General Public License
#  along with Wasp; If not, see <http://www.gnu.org/licenses/>.
# 
# license GPL-3.0 <https://www.gnu.org/licenses/gpl.html>
# 
# Significant parts of Wasp have been developed by Andrea Rossi as part of research on digital materials and discrete design at DDU Digital Design Unit - Prof. Oliver Tessmann - Technische Universität Darmstadt
geo_2 = Geometry(<brep referenced from the Rhino model>)
pt = Point([<point referenced from the Rhino model> x5])
crv_2 = Curve([<curve referenced from the Rhino model> x5])
conndir = Wasp_ConnectionFromDirection(GEO=geo_2, CEN=pt, UP=crv_2)  # -> CONN, PLN_OUT; inputs GEO: Mesh, CEN: list of Point3d, UP: list of Curve, T: list; plug-in component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
part = Wasp_BasicPart(NAME="P", GEO=geo_2, CONN=flatten(conndir.CONN))  # -> PART; inputs GEO: Mesh, CONN: list, ATTR: list; plug-in component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

defield = Wasp_DeconstructField(FIELD=loadfield)  # -> NAME, PTS, COUNT, RES, PLN, VAL, BOU, BB; plug-in component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
gradient = Gradient(LowerLimit=0, UpperLimit=1, Parameter=defield.VAL, stops=[0: RGB(0, 128, 0), 0.5: RGB(255, 255, 0), 1: RGB(255, 0, 0)])
preview = CustomPreview(Geometry=defield.PTS, Material=gradient)

rulegen = Wasp_RulesGenerator(PART=part)  # -> R; inputs PART: list, SELF_P: Boolean, SELF_C: Boolean, TYP: Boolean, GR: list; plug-in component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
fieldaggregation = Wasp_FieldDrivenAggregation(PART=flatten(part), N=Slider(250, range=0..1000), RULES=rulegen, FIELD=loadfield, RESET=Button())  # -> AGGR, PART_OUT; inputs PART: list, PREV: list, N: Int32, RULES: list, FIELD: list, MODE: Int32, GC: list, RESET: Boolean; plug-in component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
partgeo = Wasp_GetPartGeometry(PART=fieldaggregation.PART_OUT)  # -> GEO; plug-in component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
preview_2 = CustomPreview(
    Geometry=partgeo,
    Material={diffuse=RGB(221, 160, 221), emission=RGB(66, 48, 66), shine=0.5, specular=RGB(255, 255, 255), transparency=0})

# ----
# SAVE
# Fields can be saved to file and reloaded in a second
# moment or in another file.
# This is particularly useful when working with very large
# and complex fields, which can be computed only once
# and then reloaded from file (loading from file is faster
# than re-generating the whole field).
panel = Panel("D:\Github\Wasp\ExampleFiles\2.Fields")
savefield = Wasp_SaveFieldToFile(FIELD=field, PATH=panel, NAME="myField", SAVE=Button())  # -> FILE; inputs SAVE: Boolean; plug-in component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
