# Grasshopper definition 2_08_Orientable_Field.ghx (Grasshopper 1.0.7)

# ----
# Press the button to make sure the file is
# updated to latest Wasp version on your pc.
button = Button()
updatefile = Wasp_UpdateFile(UPDATE=button)  # -> LOG; inputs UPDATE: Boolean; plug-in component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

crv = Curve(<curve referenced from the Rhino model>)

# ----
# # Wasp: Discrete Design with Grasshopper plug-in (GPL) initiated by Andrea Rossi
# 
# 
# This file is part of Wasp.
# 
# Copyright (c) 2021, Andrea Rossi <a.rossi.andrea@gmail.com>
# 
# Wasp is free software; you can redistribute it and/or modify it under the terms of the GNU General Public License as published by the Free Software Foundation; either version 3 of the License, or (at your option) any later version.
# 
# Wasp is distributed in the hope that it will be useful, but WITHOUT ANY WARRANTY; without even the implied warranty of MERCHANTABILITY or FITNESS FOR A PARTICULAR PURPOSE. See the GNU General Public License for more details. You should have received a copy of the GNU General Public License
#  along with Wasp; If not, see <http://www.gnu.org/licenses/>.
# 
# license GPL-3.0 <https://www.gnu.org/licenses/gpl.html>
# 
# Significant parts of Wasp have been developed by Andrea Rossi as part of research on digital materials and discrete design at DDU Digital Design Unit - Prof. Oliver Tessmann - Technische Universität Darmstadt
# 2_08_Orientable_Fields
geo = Geometry(<brep referenced from the Rhino model>)
crv_2 = Curve([<curve referenced from the Rhino model> x8])
pt = Point([<point referenced from the Rhino model> x8])
conndir = Wasp_ConnectionFromDirection(GEO=geo, CEN=pt, UP=crv_2)  # -> CONN, PLN_OUT; inputs GEO: Mesh, CEN: list of Point3d, UP: list of Curve, T: list; plug-in component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
points = PointList(Points=pt, Size=Slider(2, range=0..10))
part = Wasp_BasicPart(NAME="P", GEO=geo, CONN=flatten(conndir.CONN))  # -> PART; inputs GEO: Mesh, CONN: list, ATTR: list; plug-in component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

bbox = BoundingBox(Content=crv, Plane=PlaneXY(0, 0, 0))  # -> Box, Box_2
volume = Volume(Geometry=bbox.Box)  # -> Volume, Centroid
scale_nu = ScaleNU(
    Geometry=bbox.Box,
    Plane=volume.Centroid,
    ScaleX=Slider(1.2, range=0..10),
    ScaleY=Slider(1.2, range=0..10),
    ScaleZ=Slider(1.7, range=0..10))  # -> Geometry, Transform

# ----
# Assignign a custom plane to the Field Points component allows to
# control the orientation of the generated point grid. This plane will also
# determine the base orientation of parts placed in the field.
number_slider = Slider(45, range=0..100)
xy = XYPlane(Origin=Point(0, 0, 0))
prot = RotatePlane(Plane=xy, Angle=degrees(number_slider))
X = UnitX(Factor=1)
rot3d = Rotate3D(Geometry=prot, Angle=degrees(Slider(0, range=0..100)), Center=Point(0, 0, 0), Axis=X)  # -> Geometry, Transform
fieldpts = Wasp_FieldPoints(BOU=scale_nu.Geometry, RES=Slider(4, range=0..10), PLN=rot3d.Geometry)  # -> E_FIELD, PTS; inputs BOU: list of Mesh, PLN: Plane; plug-in component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

pull = PullPoint(Point=fieldpts.PTS, Geometry=crv, ClosestOnly=True)  # -> ClosestPoint, Distance
bnd = Bounds(Numbers=pull.Distance)
remap = RemapNumbers(Value=pull.Distance, Source=bnd, Target="1 To 0")  # -> Mapped, Clipped
graph = GraphMapper(
    remap.Mapped,
    x0=0,
    x1=1,
    y0=0,
    y1=1,
    container_name="Bezier",
    cpx=[0, 0.7640449405, 0.8516854048, 1],
    cpy=[0, 0.1461039186, 0.4448052049, 1])
field = Wasp_Field(NAME="myField", E_FIELD=fieldpts.E_FIELD, VAL=graph)  # -> FIELD; inputs VAL: list; plug-in component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

# ----
# The Orient Field component allows to replace the Base Plane
# of the given field, resulting in a transformation of the Field in
# the new given location and orientation.
number_slider_2 = Slider(200, range=0..1000)
pt_2 = ConstructPoint(XCoordinate=number_slider_2, YCoordinate=Slider(88, range=0..1000), ZCoordinate=Slider(137, range=0..1000))
xz = XZPlane(Origin=pt_2)
prot_2 = RotatePlane(Plane=xz, Angle=degrees(Slider(45, range=0..100)))
fieldorient = Wasp_OrientField(FIELD=field, PLN=prot_2)  # -> F_TR; inputs PLN: Plane; plug-in component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

panel = Panel("""P|0_P|6
P|6_P|0
P|1_P|7
P|7_P|1
P|2_P|4
P|4_P|2
P|3_P|5
P|5_P|3""")
ruletxt = Wasp_RuleFromText(TXT=panel)  # -> R; plug-in component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
fieldaggregation = Wasp_FieldDrivenAggregation(PART=flatten(part), N=Slider(250, range=0..1000), RULES=ruletxt, FIELD=fieldorient, RESET=Button())  # -> AGGR, PART_OUT; inputs PART: list, PREV: list, N: Int32, RULES: list, FIELD: list, MODE: Int32, GC: list, RESET: Boolean; plug-in component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
partgeo = Wasp_GetPartGeometry(PART=fieldaggregation.PART_OUT)  # -> GEO; plug-in component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
preview = CustomPreview(Geometry=partgeo, Material=ColourSwatch(SwatchColor=RGB(255, 255, 255)))

defield = Wasp_DeconstructField(FIELD=fieldorient)  # -> NAME, PTS, COUNT, RES, PLN, VAL, BOU, BB; plug-in component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
geo_2 = Geometry(defield.BB)
pln = Plane(defield.PLN)
gradient = Gradient(LowerLimit=0, UpperLimit=1, Parameter=defield.VAL, stops=[0: RGB(0, 128, 0), 0.5: RGB(255, 255, 0), 1: RGB(255, 0, 0)])
preview_2 = CustomPreview(Geometry=defield.PTS, Material=gradient)
