# Grasshopper definition 2_10_Volumetric_Field.ghx (Grasshopper 1.0.7)
# plug-ins: Human

# ----
# Press the button to make sure the file is
# updated to latest Wasp version on your pc.
button = Button()
# 2_10_Volumetric_Field
updatefile = Wasp_UpdateFile(UPDATE=button)  # -> LOG; inputs UPDATE: Boolean; plug-in component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

geo = Geometry(<brep referenced from the Rhino model>)
fieldpts = Wasp_FieldPoints(BOU=geo, RES=Slider(2, range=0..10))  # -> E_FIELD, PTS; inputs BOU: list of Mesh, PLN: Plane; plug-in component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
srf_cp = SurfaceClosestPoint(Point=fieldpts.PTS, Surface=geo)  # -> Point, UVPoint, Distance
bnd = Bounds(Numbers=srf_cp.Distance)
remap = RemapNumbers(Value=srf_cp.Distance, Source=bnd, Target=Domain(0, 1))  # -> Mapped, Clipped
graph = GraphMapper(
    remap.Mapped,
    x0=0,
    x1=1,
    y0=0,
    y1=1,
    container_name="Bezier",
    cpx=[0, 0.1176404059, 0.319324851, 1],
    cpy=[0, 0.7088962793, 0.9993216991, 1])
field = Wasp_Field(NAME="myVolField", E_FIELD=fieldpts.E_FIELD, VAL=graph)  # -> FIELD; inputs VAL: list; plug-in component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

range = Range(Domain=Domain(0, 1), Steps=Slider(16, range=0..100))
range_2 = Range(Domain=Domain(0, 1), Steps=Slider(8, range=0..100))
pt = ConstructPoint(XCoordinate=range, YCoordinate=range_2, ZCoordinate=0)
iso = IsoCurve(Surface=reparameterize(geo), UVPoint=pt)  # -> UIsocurve, VIsocurve
previewlw = CustomPreviewLineweights(Geometry=[iso.UIsocurve, iso.VIsocurve], Shader=ColourSwatch(SwatchColor=RGB(64, 64, 64)), Absolute=False)

# ----
# # Wasp: Discrete Design with Grasshopper plug-in (GPL) initiated by Andrea Rossi
# 
# 
# This file is part of Wasp.
# 
# Copyright (c) 2021, Andrea Rossi <a.rossi.andrea@gmail.com>
# 
# Wasp is free software; you can redistribute it and/or modify it under the terms of the GNU General Public License as published by the Free Software Foundation; either version 3 of the License, or (at your option) any later version.
# 
# Wasp is distributed in the hope that it will be useful, but WITHOUT ANY WARRANTY; without even the implied warranty of MERCHANTABILITY or FITNESS FOR A PARTICULAR PURPOSE. See the GNU General Public License for more details. You should have received a copy of the GNU General Public License
#  along with Wasp; If not, see <http://www.gnu.org/licenses/>.
# 
# license GPL-3.0 <https://www.gnu.org/licenses/gpl.html>
# 
# Significant parts of Wasp have been developed by Andrea Rossi as part of research on digital materials and discrete design at DDU Digital Design Unit - Prof. Oliver Tessmann - Technische Universität Darmstadt
geo_2 = Geometry(<brep referenced from the Rhino model>)
crv = Curve([<curve referenced from the Rhino model> x4])
pt_2 = Point([<point referenced from the Rhino model> x4])
wires = BrepWireframe(Brep=geo_2, Density=-1)
conndir = Wasp_ConnectionFromDirection(GEO=geo_2, CEN=pt_2, UP=crv)  # -> CONN, PLN_OUT; inputs GEO: Mesh, CEN: list of Point3d, UP: list of Curve, T: list; plug-in component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
attribute = Wasp_Attribute(ID="WIRES", VAL=wires, TR=Toggle(True))  # -> ATTR; inputs VAL: list, TR: Boolean; plug-in component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
part = Wasp_BasicPart(NAME="L", GEO=geo_2, CONN=flatten(conndir.CONN), ATTR=attribute)  # -> PART; inputs GEO: Mesh, CONN: list, ATTR: list; plug-in component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

defield = Wasp_DeconstructField(FIELD=field)  # -> NAME, PTS, COUNT, RES, PLN, VAL, BOU, BB; plug-in component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
gradient = Gradient(LowerLimit=0, UpperLimit=1, Parameter=defield.VAL, stops=[0: RGB(0, 128, 0), 0.5: RGB(255, 255, 0), 1: RGB(255, 0, 0)])
preview = CustomPreview(Geometry=defield.PLN, Material=gradient)

rulegen = Wasp_RulesGenerator(PART=part)  # -> R; inputs PART: list, SELF_P: Boolean, SELF_C: Boolean, TYP: Boolean, GR: list; plug-in component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
fieldaggregation = Wasp_FieldDrivenAggregation(PART=flatten(part), N=Slider(400, range=0..1000), RULES=rulegen, FIELD=field, RESET=Button())  # -> AGGR, PART_OUT; inputs PART: list, PREV: list, N: Int32, RULES: list, FIELD: list, MODE: Int32, GC: list, RESET: Boolean; plug-in component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

lng = ListLength(List=fieldaggregation.PART_OUT)
partgeo = Wasp_GetPartGeometry(PART=fieldaggregation.PART_OUT)  # -> GEO; plug-in component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
merge = Merge(
    Data1=ColourSwatch(SwatchColor=RGB(195, 255, 0)),
    Data2=ColourSwatch(SwatchColor=RGB(53, 168, 0)),
    Data3=ColourSwatch(SwatchColor=RGB(89, 255, 0)))
random = Random(Range=Slider(2, range=0..10), Number=lng, Seed=2)
getattr = Wasp_GetAttributeByName(PART=fieldaggregation.PART_OUT, ID="WIRES")  # -> VAL; plug-in component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
item = ListItem(List=merge, Index=random, Wrap=True)
preview_2 = CustomPreview(Geometry=getattr, Material=ColourSwatch(SwatchColor=RGB(0, 0, 0)))
preview_3 = CustomPreview(Geometry=partgeo, Material=item)
