# Grasshopper definition 4_03_Local_Constraints_Adjacencies.ghx (Grasshopper 1.0.7)

# ----
# Press the button to make sure the file is
# updated to latest Wasp version on your pc.
button = Button()
# # Wasp: Discrete Design with Grasshopper plug-in (GPL) initiated by Andrea Rossi
# 
# 
# This file is part of Wasp.
# 
# Copyright (c) 2021, Andrea Rossi <a.rossi.andrea@gmail.com>
# 
# Wasp is free software; you can redistribute it and/or modify it under the terms of the GNU General Public License as published by the Free Software Foundation; either version 3 of the License, or (at your option) any later version.
# 
# Wasp is distributed in the hope that it will be useful, but WITHOUT ANY WARRANTY; without even the implied warranty of MERCHANTABILITY or FITNESS FOR A PARTICULAR PURPOSE. See the GNU General Public License for more details. You should have received a copy of the GNU General Public License
#  along with Wasp; If not, see <http://www.gnu.org/licenses/>.
# 
# license GPL-3.0 <https://www.gnu.org/licenses/gpl.html>
# 
# Significant parts of Wasp have been developed by Andrea Rossi as part of research on digital materials and discrete design at DDU Digital Design Unit - Prof. Oliver Tessmann - Technische Universität Darmstadt
# 04_3_Local_Constraints_Adjacencies and Exclusions
updatefile = Wasp_UpdateFile(UPDATE=button)  # -> LOG; inputs UPDATE: Boolean; plug-in component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

# ----
# Part-dependent adjacency and exclusion constraints
# When specifying a part name in PN, the constraints will only consider
# those parts for the adjacency or exclusion check.
toggle = BooleanToggle(True)
panel = Panel("""BOX
BOX""")
panel_2 = Panel("""STICK
STICK
STICK
STICK""")
crv = Curve([<curve referenced from the Rhino model> x2])
crv_2 = Curve([<curve referenced from the Rhino model> x4])
adjexcconst = Wasp_AdjacencyExclusionConstraint(DIR=crv, PN=panel, AE=toggle)  # -> AEC; inputs DIR: list of Curve, PN: list, AE: Boolean; plug-in component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
adjexcconst_2 = Wasp_AdjacencyExclusionConstraint(DIR=crv_2, PN=panel_2, AE=Toggle(False))  # -> AEC; inputs DIR: list of Curve, PN: list, AE: Boolean; plug-in component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
merge = Merge(Data1=adjexcconst_2, Data2=adjexcconst)

crv_3 = Curve([<curve referenced from the Rhino model> x2])
pt = Point([<point referenced from the Rhino model> x2])
crv_4 = Curve([<curve referenced from the Rhino model> x2])
geo = Geometry(<brep referenced from the Rhino model>)
pt_2 = Point([<point referenced from the Rhino model> x2])
conndir = Wasp_ConnectionFromDirection(GEO=geo, CEN=pt_2, UP=crv_4, T="SBOTTOM")  # -> out, CONN, PLN_OUT; inputs GEO: Mesh, CEN: list of Point3d, UP: list of Curve, T: list; plug-in component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
conndir_2 = Wasp_ConnectionFromDirection(GEO=geo, CEN=pt, UP=crv_3, T="SSIDE")  # -> CONN, PLN_OUT; inputs GEO: Mesh, CEN: list of Point3d, UP: list of Curve, T: list; plug-in component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
advpart = Wasp_AdvancedPart(NAME="STICK", GEO=geo, CONN=flatten([conndir.CONN, conndir_2.CONN]), AEC=merge)  # -> PART; inputs GEO: Mesh, CONN: list, HI: list, ATTR: list, SUP: list, AEC: list, OC: list; plug-in component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

# ----
# Part-indedependent adjacency constraint
# When PN is not defined, the adjacency/exclusions will
# be checked against all parts in the aggregation
toggle_2 = BooleanToggle(True)
crv_5 = Curve(<curve referenced from the Rhino model>)
adjexcconst_3 = Wasp_AdjacencyExclusionConstraint(DIR=crv_5, AE=toggle_2)  # -> AEC; inputs DIR: list of Curve, PN: list, AE: Boolean; plug-in component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

panel_3 = Panel("""HBOTTOM
HTOP""")
crv_6 = Curve([<curve referenced from the Rhino model> x3])
geo_2 = Geometry(<brep referenced from the Rhino model>)
pt_3 = Point([<point referenced from the Rhino model> x3])
crv_7 = Curve([<curve referenced from the Rhino model> x2])
pt_4 = Point([<point referenced from the Rhino model> x2])
conndir_3 = Wasp_ConnectionFromDirection(GEO=geo_2, CEN=pt_4, UP=crv_7, T=panel_3)  # -> CONN, PLN_OUT; inputs GEO: Mesh, CEN: list of Point3d, UP: list of Curve, T: list; plug-in component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
conndir_4 = Wasp_ConnectionFromDirection(GEO=geo_2, CEN=pt_3, UP=crv_6, T="HSIDE")  # -> CONN, PLN_OUT; inputs GEO: Mesh, CEN: list of Point3d, UP: list of Curve, T: list; plug-in component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
advpart_2 = Wasp_AdvancedPart(NAME="HEXA", GEO=geo_2, CONN=flatten([conndir_4.CONN, conndir_3.CONN]), AEC=adjexcconst_3)  # -> PART; inputs GEO: Mesh, CONN: list, HI: list, ATTR: list, SUP: list, AEC: list, OC: list; plug-in component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

panel_4 = Panel("""BSTART
BEND""")
crv_8 = Curve(<curve referenced from the Rhino model>)
pt_5 = Point(<point referenced from the Rhino model>)
crv_9 = Curve([<curve referenced from the Rhino model> x2])
geo_3 = Geometry(<brep referenced from the Rhino model>)
pt_6 = Point([<point referenced from the Rhino model> x2])
conndir_5 = Wasp_ConnectionFromDirection(GEO=geo_3, CEN=pt_6, UP=crv_9, T=panel_4)  # -> CONN, PLN_OUT; inputs GEO: Mesh, CEN: list of Point3d, UP: list of Curve, T: list; plug-in component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
conndir_6 = Wasp_ConnectionFromDirection(GEO=geo_3, CEN=pt_5, UP=crv_8, T="BUP")  # -> CONN, PLN_OUT; inputs GEO: Mesh, CEN: list of Point3d, UP: list of Curve, T: list; plug-in component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
part = Wasp_BasicPart(NAME="BOX", GEO=geo_3, CONN=flatten([conndir_5.CONN, conndir_6.CONN]))  # -> PART; inputs GEO: Mesh, CONN: list, ATTR: list; plug-in component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

series = Series(Start=0, Step=Slider(10, range=0..100), Count=Slider(5, range=0..10))
Y = UnitY(Factor=series)
move = Move(Motion=Y)  # -> Geometry, Transform
parttr = Wasp_TransformPart(PART=part, TR=move.Transform)  # -> PART_OUT; inputs TR: Transform; plug-in component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

merge_2 = Merge(Data1=part, Data2=advpart, Data3=advpart_2)

panel_5 = Panel("""BSTART>BEND
BEND>BSTART
BUP>SBOTTOM
SSIDE>HSIDE
HSIDE>HSIDE
HTOP>HBOTTOM""")
rulegen = Wasp_RulesGenerator(PART=merge_2, GR=panel_5)  # -> R; inputs PART: list, SELF_P: Boolean, SELF_C: Boolean, TYP: Boolean, GR: list; plug-in component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
stochasticaggregation = Wasp_StochasticAggregation(
    PART=flatten(merge_2),
    PREV=parttr,
    N=Slider(181, range=0..1000),
    RULES=rulegen,
    MODE=Slider(1, range=0..3),
    RESET=Button())  # -> AGGR, PART_OUT; inputs PART: list, PREV: list, N: Int32, RULES: list, SEED: Int32, MODE: Int32, GC: list, RESET: Boolean; plug-in component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

namefilter = Wasp_FilterPartsByName(PART=stochasticaggregation.PART_OUT, NAME="HEXA")  # -> PART_OUT, MASK; inputs PART: list, NAME: list; plug-in component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
namefilter_2 = Wasp_FilterPartsByName(PART=stochasticaggregation.PART_OUT, NAME="BOX")  # -> PART_OUT, MASK; inputs PART: list, NAME: list; plug-in component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
namefilter_3 = Wasp_FilterPartsByName(PART=stochasticaggregation.PART_OUT, NAME="STICK")  # -> PART_OUT, MASK; inputs PART: list, NAME: list; plug-in component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
partgeo = Wasp_GetPartGeometry(PART=namefilter.PART_OUT)  # -> GEO; plug-in component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
partgeo_2 = Wasp_GetPartGeometry(PART=namefilter_3.PART_OUT)  # -> GEO; plug-in component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
partgeo_3 = Wasp_GetPartGeometry(PART=namefilter_2.PART_OUT)  # -> GEO; plug-in component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
preview = CustomPreview(Geometry=partgeo, Material=ColourSwatch(SwatchColor=RGBA(255, 225, 0, 75)))
preview_2 = CustomPreview(Geometry=partgeo_2, Material=ColourSwatch(SwatchColor=RGBA(255, 0, 0, 75)))
preview_3 = CustomPreview(Geometry=partgeo_3, Material=ColourSwatch(SwatchColor=RGBA(0, 255, 225, 75)))
