# Grasshopper definition 4_04_Local_Constraints_Orientation.ghx (Grasshopper 1.0.7)

# ----
# Press the button to make sure the file is
# updated to latest Wasp version on your pc.
button = Button()
updatefile = Wasp_UpdateFile(UPDATE=button)  # -> LOG; inputs UPDATE: Boolean; plug-in component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

# ----
# Orientation Constraint
# The constraint is defined with a line placed on the part, and an angle range
# within which the part is allowed to rotate. Optionally, the rotation angle can
# be constrained to be calculated in a given plane.
number_slider = Slider(-81, range=-180..180)
xy = XYPlane(Origin=Point(0, 0, 0))
dom = ConstructDomain(DomainStart=Slider(-180, range=-180..180), DomainEnd=number_slider)
crv = Curve(<curve referenced from the Rhino model>)
adjexcconst = Wasp_OrientationConstraint(DIR=crv, R=dom, PLN=xy)  # -> OC; inputs DIR: Vector3d, PLN: Plane; plug-in component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

# ----
# # Wasp: Discrete Design with Grasshopper plug-in (GPL) initiated by Andrea Rossi
# 
# 
# This file is part of Wasp.
# 
# Copyright (c) 2021, Andrea Rossi <a.rossi.andrea@gmail.com>
# 
# Wasp is free software; you can redistribute it and/or modify it under the terms of the GNU General Public License as published by the Free Software Foundation; either version 3 of the License, or (at your option) any later version.
# 
# Wasp is distributed in the hope that it will be useful, but WITHOUT ANY WARRANTY; without even the implied warranty of MERCHANTABILITY or FITNESS FOR A PARTICULAR PURPOSE. See the GNU General Public License for more details. You should have received a copy of the GNU General Public License
#  along with Wasp; If not, see <http://www.gnu.org/licenses/>.
# 
# license GPL-3.0 <https://www.gnu.org/licenses/gpl.html>
# 
# Significant parts of Wasp have been developed by Andrea Rossi as part of research on digital materials and discrete design at DDU Digital Design Unit - Prof. Oliver Tessmann - Technische Universität Darmstadt
# 04_4_Local_Constraints_Orientation
geo = Geometry(<brep referenced from the Rhino model>)
pt = Point([<point referenced from the Rhino model> x6])
crv_2 = Curve([<curve referenced from the Rhino model> x6])
debrep = DeconstructBrep(Brep=geo)  # -> Faces, Edges, Vertices
item = ListItem(List=debrep.Faces, Index=Slider(6, range=0..10), Wrap=True)  # -> Item, Item1
geo_2 = Geometry(<brep referenced from the Rhino model>)
area = Area(Geometry=item.Item1)  # -> Area, Centroid
debrep_2 = DeconstructBrep(Brep=item.Item1)  # -> Faces, Edges, Vertices
area_2 = Area(Geometry=item.Item)  # -> Area, Centroid
geo_3 = Geometry(<brep referenced from the Rhino model>)
Y = UnitY(Factor=1)
xy_2 = XYPlane(Origin=debrep_2.Vertices)
ln = Line(StartPoint=debrep_2.Vertices, EndPoint=area.Centroid)
attribute = Wasp_Attribute(ID="BLOCK", VAL=geo_2, TR=Toggle(True))  # -> ATTR; inputs VAL: list, TR: Boolean; plug-in component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
attribute_2 = Wasp_Attribute(ID="WIN", VAL=geo_3, TR=Toggle(True))  # -> ATTR; inputs VAL: list, TR: Boolean; plug-in component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
line = LineSDL(Start=area_2.Centroid, Direction=Y, Length=1)
align = AlignPlane(Plane=xy_2, Direction=ln)  # -> Plane, Angle
conndir = Wasp_ConnectionFromDirection(GEO=geo, CEN=area_2.Centroid, UP=line, T="BOTTOM")  # -> CONN, PLN_OUT; inputs GEO: Mesh, CEN: list of Point3d, UP: list of Curve, T: list; plug-in component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
conndir_2 = Wasp_ConnectionFromDirection(GEO=geo, CEN=pt, UP=crv_2, T="SIDE")  # -> CONN, PLN_OUT; inputs GEO: Mesh, CEN: list of Point3d, UP: list of Curve, T: list; plug-in component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
connpln = Wasp_ConnectionFromPlane(PLN=align.Plane, T="TOP")  # -> CONN, PLN_OUT; inputs PLN: list of Plane, T: list; plug-in component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
advpart = Wasp_AdvancedPart(
    NAME="P",
    GEO=geo,
    CONN=flatten([conndir.CONN, connpln.CONN, conndir_2.CONN]),
    ATTR=[attribute, attribute_2],
    OC=adjexcconst)  # -> PART; inputs GEO: Mesh, CONN: list, HI: list, ATTR: list, SUP: list, AEC: list, OC: list; plug-in component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

panel = Panel("""SIDE>SIDE
TOP>BOTTOM
BOTTOM>TOP""")
rulegen = Wasp_RulesGenerator(PART=advpart, GR=panel)  # -> R; inputs PART: list, SELF_P: Boolean, SELF_C: Boolean, TYP: Boolean, GR: list; plug-in component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
stochasticaggregation = Wasp_StochasticAggregation(PART=flatten(advpart), N=Slider(150, range=0..1000), RULES=rulegen, MODE=Slider(1, range=0..1), RESET=Button())  # -> AGGR, PART_OUT; inputs PART: list, PREV: list, N: Int32, RULES: list, SEED: Int32, MODE: Int32, GC: list, RESET: Boolean; plug-in component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

getattr = Wasp_GetAttributeByName(PART=stochasticaggregation.PART_OUT, ID="BLOCK")  # -> VAL; plug-in component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
getattr_2 = Wasp_GetAttributeByName(PART=stochasticaggregation.PART_OUT, ID="WIN")  # -> VAL; plug-in component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
preview = CustomPreview(Geometry=getattr, Material=ColourSwatch(SwatchColor=RGBA(255, 255, 255, 92)))
preview_2 = CustomPreview(Geometry=getattr_2, Material=ColourSwatch(SwatchColor=RGBA(0, 255, 225, 97)))
