# Grasshopper definition 4_05_Global_Constraints_Plane.ghx (Grasshopper 1.0.7)

# ----
# Press the button to make sure the file is
# updated to latest Wasp version on your pc.
button = Button()
# 04_3_Global_Constraints_Plane
updatefile = Wasp_UpdateFile(UPDATE=button)  # -> LOG; inputs UPDATE: Boolean; plug-in component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

# ----
# # Wasp: Discrete Design with Grasshopper plug-in (GPL) initiated by Andrea Rossi
# 
# 
# This file is part of Wasp.
# 
# Copyright (c) 2021, Andrea Rossi <a.rossi.andrea@gmail.com>
# 
# Wasp is free software; you can redistribute it and/or modify it under the terms of the GNU General Public License as published by the Free Software Foundation; either version 3 of the License, or (at your option) any later version.
# 
# Wasp is distributed in the hope that it will be useful, but WITHOUT ANY WARRANTY; without even the implied warranty of MERCHANTABILITY or FITNESS FOR A PARTICULAR PURPOSE. See the GNU General Public License for more details. You should have received a copy of the GNU General Public License
#  along with Wasp; If not, see <http://www.gnu.org/licenses/>.
# 
# license GPL-3.0 <https://www.gnu.org/licenses/gpl.html>
# 
# Significant parts of Wasp have been developed by Andrea Rossi as part of research on digital materials and discrete design at DDU Digital Design Unit - Prof. Oliver Tessmann - Technische Universität Darmstadt
geo = Geometry(<brep referenced from the Rhino model>)
pt = Point([<point referenced from the Rhino model> x2])
crv = Curve([<curve referenced from the Rhino model> x2])
pt_2 = Point([<point referenced from the Rhino model> x2])
crv_2 = Curve([<curve referenced from the Rhino model> x2])
conndir = Wasp_ConnectionFromDirection(GEO=geo, CEN=pt_2, UP=crv_2, T="MID")  # -> CONN, PLN_OUT; inputs GEO: Mesh, CEN: list of Point3d, UP: list of Curve, T: list; plug-in component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
conndir_2 = Wasp_ConnectionFromDirection(GEO=geo, CEN=pt, UP=crv, T="END")  # -> CONN, PLN_OUT; inputs GEO: Mesh, CEN: list of Point3d, UP: list of Curve, T: list; plug-in component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
merge = Merge(Data1=conndir_2.CONN, Data2=conndir.CONN)
part = Wasp_BasicPart(NAME="STICK", GEO=geo, CONN=flatten(merge))  # -> PART; inputs GEO: Mesh, CONN: list, ATTR: list; plug-in component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

# ----
# PLANE CONSTRAINTS
# Plane constraints allow to constrain the growth of an aggregation
# only on the positive or negative Z (set with the POS input) of a given plane.
# Constraints can be "soft", meaning that only the centroid of the part
# is checked against the constraint, or "hard", meaning that also the geometry
# is checked for intersections (set by the SOFT input).
# Additionally, the REQ input can be used to define if a constraint is necessary
# or optional. If using a mis of necessary and optional constraints, the aggregation
# will try to place all parts which have all necessary constraints satisfyed, and
# at least one of the optional ones.
number_slider = Slider(250, range=0..1000)
neg = Negative(Value=number_slider)
neg_2 = Negative(Value=Slider(250, range=0..1000))
pt_3 = ConstructPoint(XCoordinate=0, YCoordinate=neg, ZCoordinate=0)
pt_4 = ConstructPoint(XCoordinate=0, YCoordinate=neg_2, ZCoordinate=0)
yz = YZPlane(Origin=pt_3)
xz = XZPlane(Origin=pt_4)
xy = XYPlane(Origin=Point(0, 0, 0))
planeconst = Wasp_PlaneConstraint(PLN=xz, POS=Toggle(False), SOFT=Toggle(False), REQ=Toggle(False))  # -> PC; inputs PLN: Plane, POS: Boolean, SOFT: Boolean, REQ: Boolean, PART: list; plug-in component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
planeconst_2 = Wasp_PlaneConstraint(PLN=yz, POS=Toggle(False), SOFT=Toggle(False), REQ=Toggle(False))  # -> PC; inputs PLN: Plane, POS: Boolean, SOFT: Boolean, REQ: Boolean, PART: list; plug-in component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
planeconst_3 = Wasp_PlaneConstraint(PLN=xy, POS=Toggle(True), SOFT=Toggle(True))  # -> PC; inputs PLN: Plane, POS: Boolean, SOFT: Boolean, REQ: Boolean, PART: list; plug-in component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
merge_2 = Merge(Data1=planeconst_3, Data2=planeconst, Data3=planeconst_2)

# ----
# VISUALIZE PLANE CONSTRAINTS
panel = Panel("-500 to 500")
range = Range(Domain=Domain(0, 1), Steps=10)
range_2 = Range(Domain=Domain(0, 1), Steps=10)
range_3 = Range(Domain=Domain(0, 1), Steps=10)
pt_5 = ConstructPoint(XCoordinate=range, YCoordinate=range, ZCoordinate=0)
pt_6 = ConstructPoint(XCoordinate=range_2, YCoordinate=range_2, ZCoordinate=0)
pt_7 = ConstructPoint(XCoordinate=range_3, YCoordinate=range_3, ZCoordinate=0)
planesrf = PlaneSurface(Plane=xy, XSize=panel, YSize=panel)
planesrf_2 = PlaneSurface(Plane=xz, XSize="-500 to 500", YSize="-500 to 500")
planesrf_3 = PlaneSurface(Plane=yz, XSize="-500 to 500", YSize="-500 to 500")
iso = IsoCurve(Surface=reparameterize(planesrf), UVPoint=pt_5)  # -> UIsocurve, VIsocurve
iso_2 = IsoCurve(Surface=reparameterize(planesrf_2), UVPoint=pt_6)  # -> UIsocurve, VIsocurve
iso_3 = IsoCurve(Surface=reparameterize(planesrf_3), UVPoint=pt_7)  # -> UIsocurve, VIsocurve

rulegen = Wasp_RulesGenerator(PART=part, TYP=Toggle(True))  # -> R; inputs PART: list, SELF_P: Boolean, SELF_C: Boolean, TYP: Boolean, GR: list; plug-in component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

# ----
# CONSTRAINT MODE
# Constraint mode is set to 2 to activate
# global constraints check.
number_slider_2 = Slider(500, range=0..1000)
stochasticaggregation = Wasp_StochasticAggregation(PART=flatten(part), N=number_slider_2, RULES=rulegen, MODE=Slider(2, range=0..10), GC=merge_2, RESET=Button())  # -> AGGR, PART_OUT; inputs PART: list, PREV: list, N: Int32, RULES: list, SEED: Int32, MODE: Int32, GC: list, RESET: Boolean; plug-in component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

lng = ListLength(List=stochasticaggregation.PART_OUT)
partgeo = Wasp_GetPartGeometry(PART=stochasticaggregation.PART_OUT)  # -> GEO; plug-in component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
random = Random(Range=Domain(0, 1), Number=lng, Seed=2)
gradient = Gradient(LowerLimit=0, UpperLimit=1, Parameter=random, stops=[0: RGB(128, 49, 25), 1: RGB(219, 113, 13)])
preview = CustomPreview(Geometry=partgeo, Material=gradient)
