# Grasshopper definition 4_03_Wasp_to_DisCo_VR.ghx (Grasshopper 1.0.7)

# ----
# Press the button to make sure the file is
# updated to latest Wasp version on your pc.
button = Button()
# # Wasp: Discrete Design with Grasshopper plug-in (GPL) initiated by Andrea Rossi
# 
# 
# This file is part of Wasp.
# 
# Copyright (c) 2021, Andrea Rossi <a.rossi.andrea@gmail.com>
# 
# Wasp is free software; you can redistribute it and/or modify it under the terms of the GNU General Public License as published by the Free Software Foundation; either version 3 of the License, or (at your option) any later version.
# 
# Wasp is distributed in the hope that it will be useful, but WITHOUT ANY WARRANTY; without even the implied warranty of MERCHANTABILITY or FITNESS FOR A PARTICULAR PURPOSE. See the GNU General Public License for more details. You should have received a copy of the GNU General Public License
#  along with Wasp; If not, see <http://www.gnu.org/licenses/>.
# 
# license GPL-3.0 <https://www.gnu.org/licenses/gpl.html>
# 
# Significant parts of Wasp have been developed by Andrea Rossi as part of research on digital materials and discrete design at DDU Digital Design Unit - Prof. Oliver Tessmann - Technische Universität Darmstadt
# 4_03_Wasp_to_DisCo
updatefile = Wasp_UpdateFile(UPDATE=button)  # -> LOG; inputs UPDATE: Boolean; plug-in component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

# ----
# WASP PARTS FOR DISCO
# DisCo works in meters, so the Rhino file should
# also be in meters, and the size of the parts should
# be compatible to what can be manipulated in VR.
connection_type = Panel("END")
connection_type_2 = Panel("SIDE")
connection_type_3 = Panel("SHORTSIDE")
connection_type_4 = Panel("LONGSIDE")
connection_type_5 = Panel("END")
crv = Curve([<curve referenced from the Rhino model> x2])
brep = Brep(<brep referenced from the Rhino model>)
pt = Point([<point referenced from the Rhino model> x2])
crv_2 = Curve([<curve referenced from the Rhino model> x8])
pt_2 = Point([<point referenced from the Rhino model> x8])
crv_3 = Curve([<curve referenced from the Rhino model> x9])
pt_3 = Point([<point referenced from the Rhino model> x9])
brep_2 = Brep(<brep referenced from the Rhino model>)
crv_4 = Curve([<curve referenced from the Rhino model> x5])
pt_4 = Point([<point referenced from the Rhino model> x5])
crv_5 = Curve([<curve referenced from the Rhino model> x4])
pt_5 = Point([<point referenced from the Rhino model> x4])
conndir = Wasp_ConnectionFromDirection(GEO=brep_2, CEN=pt_5, UP=crv_5, T=connection_type_5)  # -> CONN, PLN_OUT; inputs GEO: Mesh, CEN: list of Point3d, UP: list of Curve, T: list; plug-in component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
conndir_2 = Wasp_ConnectionFromDirection(GEO=brep, CEN=pt, UP=crv, T=connection_type)  # -> CONN, PLN_OUT; inputs GEO: Mesh, CEN: list of Point3d, UP: list of Curve, T: list; plug-in component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
conndir_3 = Wasp_ConnectionFromDirection(GEO=brep_2, CEN=pt_4, UP=crv_4, T=connection_type_4)  # -> CONN, PLN_OUT; inputs GEO: Mesh, CEN: list of Point3d, UP: list of Curve, T: list; plug-in component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
conndir_4 = Wasp_ConnectionFromDirection(GEO=brep_2, CEN=pt_3, UP=crv_3, T=connection_type_3)  # -> CONN, PLN_OUT; inputs GEO: Mesh, CEN: list of Point3d, UP: list of Curve, T: list; plug-in component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
conndir_5 = Wasp_ConnectionFromDirection(GEO=brep, CEN=pt_2, UP=crv_2, T=connection_type_2)  # -> CONN, PLN_OUT; inputs GEO: Mesh, CEN: list of Point3d, UP: list of Curve, T: list; plug-in component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
part_name = Panel("STICK")
part_name_2 = Panel("BRANCH")
merge = Merge(Data1=conndir_5.CONN, Data2=conndir_2.CONN)
merge_2 = Merge(Data1=conndir_3.CONN, Data2=conndir_4.CONN, Data3=conndir.CONN)
part = Wasp_BasicPart(NAME=part_name, GEO=brep, CONN=flatten(merge))  # -> PART; inputs GEO: Mesh, CONN: list, ATTR: list; plug-in component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
part_2 = Wasp_BasicPart(NAME=part_name_2, GEO=brep_2, CONN=flatten(merge_2))  # -> PART; inputs GEO: Mesh, CONN: list, ATTR: list; plug-in component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

merge_3 = Merge(Data1=part, Data2=part_2)

# ----
# RULES FILTERS
# The same rules grammars set in Wasp will be available
# in DisCo as rule filters, allowing to activate and deactivate
# different rules during the VR choreographing process.
connection_grammar_04 = Panel("""END>END
SIDE>SIDE
SIDE>LONGSIDE
LONGSIDE>SIDE
SHORTSIDE>SHORTSIDE""")
rulegen = Wasp_RulesGenerator(PART=merge_3, GR=connection_grammar_04)  # -> R; inputs PART: list, SELF_P: Boolean, SELF_C: Boolean, TYP: Boolean, GR: list; plug-in component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

Z = UnitZ(Factor=Slider(1.1, range=0..10))

# ----
# RULE GROUPS
# The different connection grammars can be grouped.
# These groups will be available on the DisCo controller,
# to quickly switch on and off several rule filters at once.
panel = Panel("""END>END
SIDE>SIDE
SIDE>LONGSIDE
LONGSIDE>SIDE
SHORTSIDE>SHORTSIDE""")
ruleg = Wasp_DisCoRuleGroup(NAME="ENDS", GR="END>END")  # -> RULE_G; inputs GR: list; plug-in component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
ruleg_2 = Wasp_DisCoRuleGroup(NAME="SIDES", GR=panel)  # -> RULE_G; inputs GR: list; plug-in component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
merge_4 = Merge(Data1=ruleg, Data2=ruleg_2)

move = Move(Motion=Z)  # -> Geometry, Transform
parttr = Wasp_TransformPart(PART=part, TR=move.Transform)  # -> PART_OUT; inputs TR: Transform; plug-in component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

geo = Geometry(<brep referenced from the Rhino model>)
meshconst = Wasp_MeshConstraint(GEO=geo, IN=Toggle(False))  # -> GC; inputs GEO: Mesh, IN: Boolean, SOFT: Boolean, REQ: Boolean, PART: list; plug-in component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

partgeo = Wasp_GetPartGeometry(PART=parttr)  # -> GEO; plug-in component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

parts_num = Slider(50, range=0..10000)
reset = Button()
stochasticaggregation = Wasp_StochasticAggregation(PART=flatten(merge_3), PREV=parttr, N=parts_num, RULES=rulegen, MODE=Slider(2, range=0..10), GC=meshconst, RESET=reset)  # -> AGGR, PART_OUT; inputs PART: list, PREV: list, N: Int32, RULES: list, SEED: Int32, MODE: Int32, GC: list, RESET: Boolean; plug-in component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

part_name_3 = Panel("STICK")
part_name_4 = Panel("BRANCH")
namefilter = Wasp_FilterPartsByName(PART=stochasticaggregation.PART_OUT, NAME=part_name_3)  # -> PART_OUT, MASK; inputs PART: list, NAME: list; plug-in component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
namefilter_2 = Wasp_FilterPartsByName(PART=stochasticaggregation.PART_OUT, NAME=part_name_4)  # -> PART_OUT, MASK; inputs PART: list, NAME: list; plug-in component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
partgeo_2 = Wasp_GetPartGeometry(PART=namefilter.PART_OUT)  # -> GEO; plug-in component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
partgeo_3 = Wasp_GetPartGeometry(PART=namefilter_2.PART_OUT)  # -> GEO; plug-in component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
preview = CustomPreview(Geometry=partgeo_2, Material=ColourSwatch(SwatchColor=RGB(196, 0, 0)))
preview_2 = CustomPreview(Geometry=partgeo_3, Material=ColourSwatch(SwatchColor=RGB(0, 88, 89)))

# ----
# LOAD FROM DISCO
# This component allows to load a DisCo-generated aggregation into Grasshopper.
# The imported aggregation can be used as base for further aggregation
# by plugging the PART_OUT output to the PREV input of
# an aggregation component.
panel_2 = Panel("D:\Github\Wasp\ExampleFiles\4.Advanced\4_03_DisCo_Save\Save_210322_15-14.json")
discoload = Wasp_LoadFromDisCo(PART=merge_3, FILE=panel_2)  # -> AGGR, PART_OUT; inputs PART: list, RENUM: Boolean; plug-in component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
partgeo_4 = Wasp_GetPartGeometry(PART=discoload.PART_OUT)  # -> GEO; plug-in component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

# ----
# SAVE TO DISCO
# This allows to save a Grasshopper-generated aggregation
# to load it in DisCo for further aggregation in VR.
panel_3 = Panel("D:\Github\Wasp\ExampleFiles\4.Advanced\4_03_DisCo_Save")
discosave = Wasp_SaveToDisCo(AGGR=stochasticaggregation.AGGR, PATH=panel_3, NAME="DisCo_Gh_Aggregation", SAVE=Button())  # -> TXT, FILE; plug-in component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

# ----
# PLAYER SETTINGS
# For the new multiplayer mode of DisCo, these components
# enable to setup different players with different tools and
# constraints applied to each of them.
toggle = BooleanToggle(False)
discoplace = Wasp_DisCoPlacementSettings(CHOREO=Toggle(False), GROW=Toggle(False))  # -> PS; inputs PLACE: Boolean, CHOREO: Boolean, SHOOT: Boolean, GROW: Boolean, PICK: Boolean, DEL: Boolean, DEL_R: Boolean, DEL_SP: Boolean, DIS: Boolean; plug-in component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
discotool = Wasp_DisCoToolSettings(PF=Toggle(False), FIELD=toggle, SCALE=Toggle(False))  # -> TS; inputs NP: Boolean, PF: Boolean, RF: Boolean, PLACE: Boolean, FIELD: Boolean, SL: Boolean, SIM: Boolean, CHAR: Boolean, SCALE: Boolean; plug-in component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
discoio = Wasp_DisCoIOSettings()  # -> IOS; inputs SAVE: Boolean, LOAD: Boolean, NEWG: Boolean, FIELD: Boolean; plug-in component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
box = Box({Plane=PlaneXY(0, -2, 0), X=Domain(0, 2), Y=Domain(0, 2), Z=Domain(0, 6)})
box_2 = Box({Plane=PlaneXY(0, 0, 0), X=Domain(0, 2), Y=Domain(0, 2), Z=Domain(0, 6)})
box_3 = Box({Plane=Plane(origin=(-2, -2, 0), x=(0, 1, 0), y=(1, 0, 0)), X=Domain(0, 2), Y=Domain(0, 2), Z=Domain(-6, 0)})
box_4 = Box({Plane=PlaneXY(-2, 0, 0), X=Domain(0, 2), Y=Domain(0, 2), Z=Domain(0, 6)})
merge_5 = Merge(Data1=box_2, Data2=box, Data3=box_3, Data4=box_4)
crv_6 = Curve([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])
pt_6 = Point([Point(0, 2, 0), Point(2, 2, 0), Point(2, 0, 0), Point(2, -2, 0), Point(0, -2, 0), Point(-2, -2, 0), Point(-2, 0, 0), Point(-2, 2, 0), Point(0, 0, 0)])
discoplayer = Wasp_DisCoPlayer(
    NAME="testPlayer",
    VRFPS=Slider(1, range=0..1),
    SCALE=Slider(1.2, range=0..10),
    TS=discotool,
    PS=discoplace,
    IOS=discoio,
    PC=pt_6,
    BC=merge_5,
    CC=crv_6,
    CCS=Slider(0.2, range=0..1))  # -> PLAY; inputs VRFPS: Int32, PC: list of Point3d, BC: list of GeometryBase, CC: list of Curve; plug-in component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

# ----
# ENVIRONMENT SETTINGS
# Settings for the different parameters of the
# game environment, including additional geometries
# and blueprints.
number_slider = Slider(1, range=0..10)
box_5 = Box({Plane=PlaneXY(-3, -3, 0), X=Domain(0, 6), Y=Domain(0, 6), Z=Domain(0, 7)})
geo_2 = Geometry([<brep referenced from the Rhino model> x3])
geo_3 = Geometry([<brep referenced from the Rhino model> x2])
discoenv = Wasp_DisCoEnvironment(GA=box_5, EG=geo_2, BPG=geo_3, GP=Toggle(True), FR=number_slider)  # -> ENV; inputs GA: GeometryBase, EG: list of Mesh, BPG: list of Mesh, GP: Boolean; plug-in component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

# ----
# AGGREGATION SETTINGS
spawn = Panel("""100
200""")
probabilities = Panel("""0.3
0.7""")
discosetup = Wasp_DisCoAggregationSetup(PART=merge_3, RULES=rulegen, RULE_G=merge_4, SPAWN_N=spawn)  # -> SETUP; inputs PART: list, RULES: list, RULE_G: list, PROB: list, SPAWN_N: list of Int32; plug-in component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

# ----
# WASP 2 DISCO
# Saves a "_setup" and a "_player" json files, each storing
# all the given information. The files can be loaded from the
# DisCo settings tab.
panel_4 = Panel("DisCo_Example")
wasp2disco = Wasp_ExportToDisCo(
    SETUP=discosetup,
    ENV=discoenv,
    PLAY=discoplayer,
    PATH="D:\Github\Wasp\ExampleFiles\4.Advanced",
    NAME=panel_4,
    SAVE=Button())  # -> FILES, SF, PF; inputs PLAY: list, SAVE: Boolean; plug-in component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
