# Grasshopper definition 4_05_Graph_Grammar_Aggregation.ghx (Grasshopper 1.0.7)

# ----
# Press the button to make sure the file is
# updated to latest Wasp version on your pc.
button = Button()
updatefile = Wasp_UpdateFile(UPDATE=button)  # -> LOG; inputs UPDATE: Boolean; plug-in component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

geo = Geometry(<brep referenced from the Rhino model>)
pt = Point([<point referenced from the Rhino model> x2])
crv = Curve([<curve referenced from the Rhino model> x2])
conndir = Wasp_ConnectionFromDirection(GEO=geo, CEN=pt, UP=crv)  # -> CONN, PLN_OUT; inputs GEO: Mesh, CEN: list of Point3d, UP: list of Curve, T: list; plug-in component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
attribute = Wasp_Attribute(ID="GEO", VAL=geo, TR=Toggle(True))  # -> ATTR; inputs VAL: list, TR: Boolean; plug-in component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
part = Wasp_BasicPart(NAME="CUBE", GEO=geo, CONN=flatten(conndir.CONN), ATTR=attribute)  # -> PART; inputs GEO: Mesh, CONN: list, ATTR: list; plug-in component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

# ----
# 4_05_Graph_Grammar_Aggregation
geo_2 = Geometry(<brep referenced from the Rhino model>)
pt_2 = Point([<point referenced from the Rhino model> x3])
crv_2 = Curve([<curve referenced from the Rhino model> x3])
conndir_2 = Wasp_ConnectionFromDirection(GEO=geo_2, CEN=pt_2, UP=crv_2)  # -> CONN, PLN_OUT; inputs GEO: Mesh, CEN: list of Point3d, UP: list of Curve, T: list; plug-in component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
attribute_2 = Wasp_Attribute(ID="GEO", VAL=geo_2, TR=Toggle(True))  # -> ATTR; inputs VAL: list, TR: Boolean; plug-in component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
# # Wasp: Discrete Design with Grasshopper plug-in (GPL) initiated by Andrea Rossi
# 
# 
# This file is part of Wasp.
# 
# Copyright (c) 2021, Andrea Rossi <a.rossi.andrea@gmail.com>
# 
# Wasp is free software; you can redistribute it and/or modify it under the terms of the GNU General Public License as published by the Free Software Foundation; either version 3 of the License, or (at your option) any later version.
# 
# Wasp is distributed in the hope that it will be useful, but WITHOUT ANY WARRANTY; without even the implied warranty of MERCHANTABILITY or FITNESS FOR A PARTICULAR PURPOSE. See the GNU General Public License for more details. You should have received a copy of the GNU General Public License
#  along with Wasp; If not, see <http://www.gnu.org/licenses/>.
# 
# license GPL-3.0 <https://www.gnu.org/licenses/gpl.html>
# 
# Significant parts of Wasp have been developed by Andrea Rossi as part of research on digital materials and discrete design at DDU Digital Design Unit - Prof. Oliver Tessmann - Technische Universität Darmstadt
panel = Panel("HEXA")
part_2 = Wasp_BasicPart(NAME=panel, GEO=geo_2, CONN=flatten(conndir_2.CONN), ATTR=attribute_2)  # -> PART; inputs GEO: Mesh, CONN: list, ATTR: list; plug-in component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

merge = Merge(Data1=part_2, Data2=part)

# ----
# The Graph-Grammar Aggregation allows to create an aggregation where each
# aggregation step is defined by the user. This is achieve by defining a list of rules using
# a specific formatting as "P1|c1_P2|c2>id1_id2", where:
# - "P1" specifies the first part. For the first rule, this is the name of the first part to be added.
#   From the second rule on, this is the id of one of the already added parts from where to grow.
# - "c1" is the connection used on the first part.
# - "P2" is the name of the new part to be added.
# - "c2" is the connection to be used on the new part.
# - "id1" and "id2" are the ids to be assigned to both placed parts. These ids can then be used
#   as "P1" in following rules.
panel_2 = Panel("""HEXA|0_HEXA|0>a_b
b|1_HEXA|2>b_c
c|1_HEXA|0>c_d
a|1_CUBE|1>a_e""")
graphaggr = Wasp_GraphGrammarAggregation(PART=flatten(merge), RULES=panel_2, RESET=Button())  # -> AGGR, PART_OUT; inputs PART: list, PREV: list, RULES: list, RESET: Boolean; plug-in component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

getattr = Wasp_GetAttributeByName(PART=graphaggr.PART_OUT, ID="GEO")  # -> VAL; plug-in component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
preview = CustomPreview(Geometry=getattr, Material=ColourSwatch(SwatchColor=RGB(51, 255, 0)))
