# Grasshopper definition 5_01_Hierarchical_Aggregation.ghx (Grasshopper 1.0.7)

# ----
# Press the button to make sure the file is
# updated to latest Wasp version on your pc.
button = Button()
# # Wasp: Discrete Design with Grasshopper plug-in (GPL) initiated by Andrea Rossi
# 
# 
# This file is part of Wasp.
# 
# Copyright (c) 2021, Andrea Rossi <a.rossi.andrea@gmail.com>
# 
# Wasp is free software; you can redistribute it and/or modify it under the terms of the GNU General Public License as published by the Free Software Foundation; either version 3 of the License, or (at your option) any later version.
# 
# Wasp is distributed in the hope that it will be useful, but WITHOUT ANY WARRANTY; without even the implied warranty of MERCHANTABILITY or FITNESS FOR A PARTICULAR PURPOSE. See the GNU General Public License for more details. You should have received a copy of the GNU General Public License
#  along with Wasp; If not, see <http://www.gnu.org/licenses/>.
# 
# license GPL-3.0 <https://www.gnu.org/licenses/gpl.html>
# 
# Significant parts of Wasp have been developed by Andrea Rossi as part of research on digital materials and discrete design at DDU Digital Design Unit - Prof. Oliver Tessmann - Technische Universität Darmstadt
# 5_01_Hierarchical_Aggregation
updatefile = Wasp_UpdateFile(UPDATE=button)  # -> LOG; inputs UPDATE: Boolean; plug-in component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

# ----
# Defining the transformations required to
# assemble the higher level part from the
# sub-parts.
pt = Point(<point referenced from the Rhino model>)
panel = Panel("""0
90
180
270""")
xy = XYPlane(Origin=pt)
panel_2 = Panel("""0
180""")
xz = XZPlane(Origin=pt)
rotate = Rotate(Angle=degrees(panel_2), Plane=xz)  # -> Geometry, Transform
rotate_2 = Rotate(Angle=degrees(panel), Plane=xy)  # -> Geometry, Transform
crossref = CrossReference(ListA=rotate_2.Transform, ListB=rotate.Transform, CrossMode=1)  # -> graft(ListA), graft(ListB)
comp = Compound(Transforms=[crossref.ListA, crossref.ListB])  # -> flatten(Compound)

crv = Curve([<curve referenced from the Rhino model> x3])

# ----
# Definition of a sub-part
# (must be created using the AdvancedPart component)
geo = Geometry(<brep referenced from the Rhino model>)
pt_2 = Point([<point referenced from the Rhino model> x3])
pt_3 = Point([<point referenced from the Rhino model> x3])
crv_2 = Curve([<curve referenced from the Rhino model> x3])
conndir = Wasp_ConnectionFromDirection(GEO=geo, CEN=pt_3, UP=crv_2)  # -> CONN, PLN_OUT; inputs GEO: Mesh, CEN: list of Point3d, UP: list of Curve, T: list; plug-in component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
conndir_2 = Wasp_ConnectionFromDirection(GEO=geo, CEN=pt_2, UP=crv)  # -> CONN, PLN_OUT; inputs GEO: Mesh, CEN: list of Point3d, UP: list of Curve, T: list; plug-in component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
merge = Merge(Data1=conndir.CONN, Data2=conndir_2.CONN)
advpart = Wasp_AdvancedPart(NAME="STICK", GEO=geo, CONN=flatten(merge))  # -> PART; inputs GEO: Mesh, CONN: list, HI: list, ATTR: list, SUP: list, AEC: list, OC: list; plug-in component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

# ----
# Assembling the Part Hierarchy
parthierarchy = Wasp_AssemblePartHierarchy(PART=advpart, TR=comp)  # -> HIE; inputs TR: Transform; plug-in component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
partgeo = Wasp_GetPartGeometry(PART=parthierarchy)  # -> GEO; plug-in component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

# ----
# Creating the higher level part.
# The geometry of the part itself does not need
# to match the geometry of the lower hierarchy
# parts.
# Atrribute containing the part edges
# (for visualization)
panel_3 = Panel("BOTTOM")
crv_3 = Curve([<curve referenced from the Rhino model> x4])
crv_4 = Curve([<curve referenced from the Rhino model> x4])
pt_4 = Point([<point referenced from the Rhino model> x4])
pt_5 = Point([<point referenced from the Rhino model> x4])
geo_2 = Geometry(<brep referenced from the Rhino model>)
conndir_3 = Wasp_ConnectionFromDirection(GEO=geo_2, CEN=pt_5, UP=crv_4, T=panel_3)  # -> CONN, PLN_OUT; inputs GEO: Mesh, CEN: list of Point3d, UP: list of Curve, T: list; plug-in component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
edges = BrepEdges(Brep=geo_2)  # -> Naked, Interior, NonManifold
conndir_4 = Wasp_ConnectionFromDirection(GEO=geo_2, CEN=pt_4, UP=crv_3, T="TOP")  # -> CONN, PLN_OUT; inputs GEO: Mesh, CEN: list of Point3d, UP: list of Curve, T: list; plug-in component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
merge_2 = Merge(Data1=conndir_4.CONN, Data2=conndir_3.CONN)
attribute = Wasp_Attribute(ID="EDGES", VAL=edges.Interior, TR=Toggle(True))  # -> ATTR; inputs VAL: list, TR: Boolean; plug-in component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
advpart_2 = Wasp_AdvancedPart(NAME="OCTA", GEO=geo_2, CONN=flatten(merge_2), HI=parthierarchy, ATTR=attribute)  # -> PART; inputs GEO: Mesh, CONN: list, HI: list, ATTR: list, SUP: list, AEC: list, OC: list; plug-in component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

# ----
# Aggregating the higher level part
panel_4 = Panel("""TOP>BOTTOM
BOTTOM>TOP""")
rulegen = Wasp_RulesGenerator(PART=advpart_2, GR=panel_4)  # -> R; inputs PART: list, SELF_P: Boolean, SELF_C: Boolean, TYP: Boolean, GR: list; plug-in component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
stochasticaggregation = Wasp_StochasticAggregation(PART=flatten(advpart_2), N=Slider(50, range=0..1000), RULES=rulegen, RESET=Button())  # -> AGGR, PART_OUT; inputs PART: list, PREV: list, N: Int32, RULES: list, SEED: Int32, MODE: Int32, GC: list, RESET: Boolean; plug-in component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

# ----
# Visualization of Edges Attribute
panel_5 = Panel("EDGES")
getattr = Wasp_GetAttributeByName(PART=stochasticaggregation.PART_OUT, ID=panel_5)  # -> VAL; plug-in component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
dash = DashPattern(Curve=getattr, Pattern="0.5")  # -> Dashes, Gaps
preview = CustomPreview(Geometry=dash.Dashes, Material=ColourSwatch(SwatchColor=RGB(0, 0, 0)))

# ----
# Extracting the lower hierarchy parts.
# The current file only contains two levels (0 and 1),
# but if more levels were available, they could be
# navigated with the slider.
number_slider = Slider(1, range=0..1)
gethierarchy = Wasp_GetPartsHierarchy(AGGR=stochasticaggregation.AGGR, LEVEL=number_slider)  # -> flatten(SUB_P); inputs LEVEL: Int32; plug-in component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

# ----
# Aggregating the extracted sub-parts.
# always reset the aggregation when
# changing the higher level aggregation.
toggle = BooleanToggle(False)
rulegen_2 = Wasp_RulesGenerator(PART=advpart, SELF_C=toggle)  # -> R; inputs PART: list, SELF_P: Boolean, SELF_C: Boolean, TYP: Boolean, GR: list; plug-in component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
stochasticaggregation_2 = Wasp_StochasticAggregation(PART=flatten(advpart), PREV=gethierarchy, N=Slider(500, range=0..1000), RULES=rulegen_2, RESET=Button())  # -> AGGR, PART_OUT; inputs PART: list, PREV: list, N: Int32, RULES: list, SEED: Int32, MODE: Int32, GC: list, RESET: Boolean; plug-in component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
lng = ListLength(List=gethierarchy)
split = SplitList(List=stochasticaggregation_2.PART_OUT, Index=lng)  # -> ListA, ListB

# ----
# Parts from higher level aggregation
# Newly aggregated sub-parts
partgeo_2 = Wasp_GetPartGeometry(PART=split.ListB)  # -> GEO; plug-in component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
partgeo_3 = Wasp_GetPartGeometry(PART=split.ListA)  # -> GEO; plug-in component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
preview_2 = CustomPreview(Geometry=partgeo_2, Material=ColourSwatch(SwatchColor=RGB(0, 132, 255)))
preview_3 = CustomPreview(Geometry=partgeo_3, Material=ColourSwatch(SwatchColor=RGB(42, 0, 255)))
