# Grasshopper definition 5_02_Hierarchical_Aggregation_LEGO.ghx (Grasshopper 1.0.7)

# ----
# Press the button to make sure the file is
# updated to latest Wasp version on your pc.
button = Button()
updatefile = Wasp_UpdateFile(UPDATE=button)  # -> LOG; inputs UPDATE: Boolean; plug-in component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

# ----
# # Wasp: Discrete Design with Grasshopper plug-in (GPL) initiated by Andrea Rossi
# 
# 
# This file is part of Wasp.
# 
# Copyright (c) 2021, Andrea Rossi <a.rossi.andrea@gmail.com>
# 
# Wasp is free software; you can redistribute it and/or modify it under the terms of the GNU General Public License as published by the Free Software Foundation; either version 3 of the License, or (at your option) any later version.
# 
# Wasp is distributed in the hope that it will be useful, but WITHOUT ANY WARRANTY; without even the implied warranty of MERCHANTABILITY or FITNESS FOR A PARTICULAR PURPOSE. See the GNU General Public License for more details. You should have received a copy of the GNU General Public License
#  along with Wasp; If not, see <http://www.gnu.org/licenses/>.
# 
# license GPL-3.0 <https://www.gnu.org/licenses/gpl.html>
# 
# Significant parts of Wasp have been developed by Andrea Rossi as part of research on digital materials and discrete design at DDU Digital Design Unit - Prof. Oliver Tessmann - Technische Universität Darmstadt
# 5_02_Hierarchical_Aggregation_LEGO
# 1. Base Part
geo = Geometry(<brep referenced from the Rhino model>)
debrep = DeconstructBrep(Brep=geo)  # -> Faces, Edges, Vertices
item = ListItem(List=debrep.Faces, Index=Slider(4, range=0..10), Wrap=True)
item_2 = ListItem(List=debrep.Faces, Index=Slider(5, range=0..10), Wrap=True)
area = Area(Geometry=item)  # -> Area, Centroid
area_2 = Area(Geometry=item_2)  # -> Area, Centroid
X = UnitX(Factor=1)
Y = UnitY(Factor=1)
X_2 = UnitX(Factor=1)
Y_2 = UnitY(Factor=1)
geo_2 = Geometry(<brep referenced from the Rhino model>)
line = LineSDL(Start=area.Centroid, Direction=[X, Y], Length=1)
line_2 = LineSDL(Start=area_2.Centroid, Direction=[X_2, Y_2], Length=1)
end = EndPoints(Curve=line)  # -> Start, End
end_2 = EndPoints(Curve=line_2)  # -> Start, End
conndir = Wasp_ConnectionFromDirection(GEO=geo, CEN=end.Start, UP=line, T="BOTTOM")  # -> CONN, PLN_OUT; inputs GEO: Mesh, CEN: list of Point3d, UP: list of Curve, T: list; plug-in component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
conndir_2 = Wasp_ConnectionFromDirection(GEO=geo, CEN=end_2.Start, UP=line_2, T="TOP")  # -> CONN, PLN_OUT; inputs GEO: Mesh, CEN: list of Point3d, UP: list of Curve, T: list; plug-in component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
attribute = Wasp_Attribute(ID="DETAIL", VAL=geo_2, TR=Toggle(True))  # -> ATTR; inputs VAL: list, TR: Boolean; plug-in component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
advpart = Wasp_AdvancedPart(NAME="BRICK", GEO=geo, CONN=flatten([conndir.CONN, conndir_2.CONN]), ATTR=attribute)  # -> PART; inputs GEO: Mesh, CONN: list, HI: list, ATTR: list, SUP: list, AEC: list, OC: list; plug-in component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

# ----
# 2a. Hierarchical Part / L-Shape
panel = Panel("""1
2
3
4
4""")
panel_2 = Panel("""0
0
0
0
1""")
Y_3 = UnitY(Factor=panel)
X_3 = UnitX(Factor=panel_2)
addition = Addition(A=X_3, B=Y_3)
multiplication = Multiplication(A=addition, B=Slider(8, range=0..10))
move = Move(Motion=multiplication)  # -> Geometry, Transform
parttr = Wasp_TransformPart(PART=advpart, TR=move.Transform)  # -> PART_OUT; inputs TR: Transform; plug-in component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
depart = Wasp_DeconstructPart(PART=parttr)  # -> NAME, ID, GEO, CENTER, CONN, COLL, TR, PARENT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; plug-in component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
deattr = Wasp_DeconstructAttribute(ATTR=depart.ATTR)  # -> ID, VAL; plug-in component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
munion = MeshUnion(Meshes=depart.GEO)
sunion = SolidUnion(Breps=flatten(deattr.VAL))
parthierarchy = Wasp_AssemblePartHierarchy(PART=advpart, TR=move.Transform)  # -> HIE; inputs TR: Transform; plug-in component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
fmerge = MergeFaces(Brep=sunion)  # -> Breps, Before, After
attribute_2 = Wasp_Attribute(ID="DETAIL", VAL=fmerge.Breps, TR=Toggle(True))  # -> ATTR; inputs VAL: list, TR: Boolean; plug-in component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
advpart_2 = Wasp_AdvancedPart(NAME="L", GEO=munion, CONN=flatten(depart.CONN), HI=parthierarchy, ATTR=attribute_2)  # -> PART; inputs GEO: Mesh, CONN: list, HI: list, ATTR: list, SUP: list, AEC: list, OC: list; plug-in component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

# ----
# 2a. Hierarchical Part / 5x1 Stick
panel_3 = Panel("""1
2
3
4
5""")
panel_4 = Panel("""0
0
0
0
0""")
Y_4 = UnitY(Factor=panel_3)
X_4 = UnitX(Factor=panel_4)
addition_2 = Addition(A=X_4, B=Y_4)
multiplication_2 = Multiplication(A=addition_2, B=Slider(8, range=0..10))
move_2 = Move(Motion=multiplication_2)  # -> Geometry, Transform
parttr_2 = Wasp_TransformPart(PART=advpart, TR=move_2.Transform)  # -> PART_OUT; inputs TR: Transform; plug-in component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
depart_2 = Wasp_DeconstructPart(PART=parttr_2)  # -> NAME, ID, GEO, CENTER, CONN, COLL, TR, PARENT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; plug-in component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
deattr_2 = Wasp_DeconstructAttribute(ATTR=depart_2.ATTR)  # -> ID, VAL; plug-in component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
munion_2 = MeshUnion(Meshes=depart_2.GEO)
sunion_2 = SolidUnion(Breps=flatten(deattr_2.VAL))
fmerge_2 = MergeFaces(Brep=sunion_2)  # -> Breps, Before, After
parthierarchy_2 = Wasp_AssemblePartHierarchy(PART=advpart, TR=move_2.Transform)  # -> HIE; inputs TR: Transform; plug-in component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
attribute_3 = Wasp_Attribute(ID="DETAIL", VAL=fmerge_2.Breps, TR=Toggle(True))  # -> ATTR; inputs VAL: list, TR: Boolean; plug-in component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
advpart_3 = Wasp_AdvancedPart(NAME="5x1", GEO=munion_2, CONN=flatten(depart_2.CONN), HI=parthierarchy_2, ATTR=attribute_3)  # -> PART; inputs GEO: Mesh, CONN: list, HI: list, ATTR: list, SUP: list, AEC: list, OC: list; plug-in component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

merge = Merge(Data1=advpart_2, Data2=advpart_3)

# ----
# 3. Aggregation at level 0
panel_5 = Panel("""TOP>BOTTOM
BOTTOM>TOP""")
rulegen = Wasp_RulesGenerator(PART=merge, GR=panel_5)  # -> R; inputs PART: list, SELF_P: Boolean, SELF_C: Boolean, TYP: Boolean, GR: list; plug-in component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
stochasticaggregation = Wasp_StochasticAggregation(PART=flatten(merge), N=Slider(100, range=0..1000), RULES=rulegen, RESET=Button())  # -> AGGR, PART_OUT; inputs PART: list, PREV: list, N: Int32, RULES: list, SEED: Int32, MODE: Int32, GC: list, RESET: Boolean; plug-in component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
namefilter = Wasp_FilterPartsByName(PART=stochasticaggregation.PART_OUT, NAME="5x1")  # -> PART_OUT, MASK; inputs PART: list, NAME: list; plug-in component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
namefilter_2 = Wasp_FilterPartsByName(PART=stochasticaggregation.PART_OUT, NAME="L")  # -> PART_OUT, MASK; inputs PART: list, NAME: list; plug-in component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
getattr = Wasp_GetAttributeByName(PART=namefilter.PART_OUT, ID="DETAIL")  # -> VAL; plug-in component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
getattr_2 = Wasp_GetAttributeByName(PART=namefilter_2.PART_OUT, ID="DETAIL")  # -> VAL; plug-in component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
preview = CustomPreview(Geometry=getattr, Material=ColourSwatch(SwatchColor=RGB(168, 168, 168)))
preview_2 = CustomPreview(Geometry=getattr_2, Material=ColourSwatch(SwatchColor=RGB(212, 212, 212)))

# ----
# 4. Extracting
# level 1 parts
number_slider = Slider(1, range=0..1)
gethierarchy = Wasp_GetPartsHierarchy(AGGR=stochasticaggregation.AGGR, LEVEL=number_slider)  # -> flatten(SUB_P); inputs LEVEL: Int32; plug-in component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

# ----
# 5. Level 1 aggregation
panel_6 = Panel("""TOP>BOTTOM
BOTTOM>TOP""")
rulegen_2 = Wasp_RulesGenerator(PART=advpart, GR=panel_6)  # -> R; inputs PART: list, SELF_P: Boolean, SELF_C: Boolean, TYP: Boolean, GR: list; plug-in component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
lng = ListLength(List=gethierarchy)

stochasticaggregation_2 = Wasp_StochasticAggregation(PART=flatten(advpart), PREV=gethierarchy, N=Slider(100, range=0..1000), RULES=rulegen_2, RESET=Button())  # -> AGGR, PART_OUT; inputs PART: list, PREV: list, N: Int32, RULES: list, SEED: Int32, MODE: Int32, GC: list, RESET: Boolean; plug-in component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

split = SplitList(List=stochasticaggregation_2.PART_OUT, Index=lng)  # -> ListA, ListB
getattr_3 = Wasp_GetAttributeByName(PART=split.ListB, ID="DETAIL")  # -> VAL; plug-in component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
preview_3 = CustomPreview(Geometry=getattr_3, Material=ColourSwatch(SwatchColor=RGB(132, 255, 0)))
